vi "symbol_energy.gvi"   [LabVIEW NXG]
inputs:
  "input symbols": c128[]
  "Symbol Energy (1)": f64 = 1
outputs:
  "output symbols": c128[]
diagram:
  # Compute average energy of input
  Square Root(x=$"Symbol Energy (1)") -> w1
  Complex To Polar(r * e^(i*theta)=$"input symbols") -> (r=w2)
  Multiply(w2, w2) -> w3
  # Normalize symbol energy
  # and apply input symbol energy
  call "Mean (DBL).gvi"(X=w3) -> (mean=w4)
  Add(w4, 1e-16) -> w5
  Reciprocal(x=w5) -> w6
  Square Root(x=w6) -> w7
  Multiply(w1, w7, $"input symbols") -> w8
  $"output symbols" <- w8
