vi "transmitter_enque (SubVI).gvi"   [LabVIEW NXG]
inputs:
  "queue in": cluster{"Key Bit Sequence": Queue<u8[]>}
  "error in": error
  "key bit stream 1": i8[]
outputs:
  "error out": error
  "queue out": cluster{"Key Bit Sequence": Queue<u8[]>}
diagram:
  Property Node(instance in=$"queue in") -> (instance out=w1, "Key Bit Sequence"=w2)
  $"queue out" <- w1
  Enqueue Element At Opposite End(element=$"key bit stream 1", error in (no error)=$"error in", queue=w2) -> (error out=w3)
  $"error out" <- w3
