vi "TXRF_send_MIMO.gvi"   [LabVIEW NXG]
inputs:
  "USRP Session in": niUSRP
  "error in": error
  "IQ Data in": cluster{"t0": f64, "dt": f64, "Y": c128[]} = {"t0"=0, "dt"=1, "Y"=[]}
  "end of data?": bool
  "HW Parameters In": T1 = {"Active Antenna"="TX1", "Carrier Frequency (Hz)"=915000000, "Gain (dB)"=10, "Generation Mode"="Single Shot", "Device IP Address"="192.168.10.3"}
  "IQ Data in_2": cluster{"t0": f64, "dt": f64, "Y": c128[]} = {"t0"=0, "dt"=1, "Y"=[]}
outputs:
  "HW Parameters Out": T1
  "error out": error
  "USRP Session out": niUSRP
panel indicators:
  "x": f64[]
types:
  T1 = cluster{"Active Antenna": string, "Carrier Frequency (Hz)": f64, "Gain (dB)": f64, "Generation Mode": enum{"Single Shot", "Simulate", "Continuous"}, "Device IP Address": string}
diagram:
  Property Node(instance in=$"IQ Data in") -> ("Y"=w1)
  Property Node(instance in=$"IQ Data in_2") -> ("Y"=w2)
  Add(w1, w2) -> w3
  Complex To Real Imaginary(x + iy=w3) -> (x=w4)
  $x <- w4
  $"HW Parameters Out" <- $"HW Parameters In"
  Build Array(w1, w2) -> w5
  case ($"error in") {
    frame No Error {
      call "niUSRP Write Tx Data (2D CDB).gvi"(session handle=$"USRP Session in", data=w5, timeout=10, end of data?=$"end of data?", error in (no error)=$"error in") -> (session handle out=w7, Error Out=w6)
      $"USRP Session out" <- w7
    }
    frame Error {
      call "niUSRP Close Session.gvi"(Handle in=$"USRP Session in", error in (no error)=$"error in") -> (Error Out=w6)
    }
  }
  $"error out" <- w6
