vi "MRC-RX.gvi"   [LabVIEW NXG]
inputs:
  "Channel estimates": T7
  "Modulation Parameters In": T6 = {"Modulation Type"="QPSK", "Control Information\nfor Packet Header/Tail"={"Training Sequence 1 (derived)"=[], "Zero Pad Length"=0, "Training Sequence 2 (derived)"=[]}, "RX Oversample Factor"=20, "Synchronization Options"={"Synchronization Method"="Timing Estimation", "Fixed Offset"=0, "Symbol Timing Recovery Method"="Max Energy", "Frame Detection Method"="Sliding Correlator", "Correct Frequency Offset"=FALSE}, "Number of Data Symbols (Derived)"=250, "RX Sample Rate"=4000000, "Pulse Shaping Parameters"={"Modulation Type"="PSK", "Pulse Shaping Filter"="Raised Cosine", "Filter Parameter"=0.5, "Filter Length (Symbols)"=8}, "Channel Estimation/Equalization Parameters"={"Equalization Method"="Direct", "Channel Estimate Length"=4, "Equalizer Length"=4, "Equalizer Delay"=-1}}
  "Input Complex Symbols 1": c128[]
  "Input Complex Symbols 2": c128[]
  "error in (no error)": error
outputs:
  "Output Complex Symbols": c128[]
  "Modulation Parameters Out": T6
  "error out": error
types:
  T1 = cluster{"Training Sequence 1 (derived)": c128[], "Zero Pad Length": i32, "Training Sequence 2 (derived)": c128[]}
  T2 = cluster{"Synchronization Method": string, "Fixed Offset": i32, "Symbol Timing Recovery Method": string, "Frame Detection Method": string, "Correct Frequency Offset": bool}
  T3 = enum{"none", "Raised Cosine", "Root Raised Cos", "Gaussian"}
  T4 = cluster{"Modulation Type": enum{"FSK", "PSK", "QAM", "MSK", "PAM", "ASK"}, "Pulse Shaping Filter": T3, "Filter Parameter": f64, "Filter Length (Symbols)": i32}
  T5 = cluster{"Equalization Method": string, "Channel Estimate Length": i32, "Equalizer Length": i32, "Equalizer Delay": i32}
  T6 = cluster{"Modulation Type": string, "Control Information\nfor Packet Header/Tail": T1, "RX Oversample Factor": i32, "Synchronization Options": T2, "Number of Data Symbols (Derived)": i32, "RX Sample Rate": f64, "Pulse Shaping Parameters": T4, "Channel Estimation/Equalization Parameters": T5}
  T7 = cluster{"Element 1": c128[], "Element 2": c128[], "Element 3": c128[], "Element 4": c128[]}
diagram:
  Property Node(instance in=$"Channel estimates") -> ("Element 1"=w1, "Element 2"=w2, "Element 3"=w3, "Element 4"=w4)
  Complex Conjugate(x + iy=w1) -> w5
  Array Index(array=w5) -> (out0[0]=w6)
  Multiply(w6, $"Input Complex Symbols 1") -> w7
  Complex Conjugate(x + iy=w2) -> w8
  Array Index(array=w8) -> (out0[0]=w9)
  Multiply(w9, $"Input Complex Symbols 1") -> w10
  Complex Conjugate(x + iy=w3) -> w11
  Array Index(array=w11) -> (out0[0]=w12)
  Multiply(w12, $"Input Complex Symbols 2") -> w13
  Complex Conjugate(x + iy=w4) -> w14
  Array Index(array=w14) -> (out0[0]=w15)
  Multiply(w15, $"Input Complex Symbols 2") -> w16
  Add(w7, w10, w13, w16) -> w17
  # divide by lambda
  Complex To Polar(r * e^(i*theta)=w17) -> (r=w18)
  Divide(x=w17, y=w18) -> w19
  $"Output Complex Symbols" <- w19
  $"error out" <- $"error in (no error)"
  $"Modulation Parameters Out" <- $"Modulation Parameters In"
