vi "RXRF_close_MIMO (SubVI).gvi"   [LabVIEW NXG]
inputs:
  "HW Parameters In": T1 = {"Active Antenna"="RX1", "Carrier Frequency (Hz)"=915000000, "Gain (dB)"=10, "Trigger Level"=0.01, "Bandwidth (Hz)"=915000000, "Reference Position (%)"=10, "Capture Time (s)"=0.0033, "Simulate"=FALSE, "Device IP Address"="192.168.10.2"}
  "error in": error
  "queue in": cluster{"Key Bit Sequence": Queue<u8[]>}
  "USRP Session": niUSRP
outputs:
  "error out": error
types:
  T1 = cluster{"Active Antenna": string, "Carrier Frequency (Hz)": f64, "Gain (dB)": f64, "Trigger Level": f64, "Bandwidth (Hz)": f64, "Reference Position (%)": f64, "Capture Time (s)": f64, "Simulate": bool, "Device IP Address": string}
diagram:
  Property Node(instance in=$"queue in") -> ("Key Bit Sequence"=w1)
  Property Node(instance in=$"HW Parameters In") -> ("Simulate"=w2)
  case (w2) {
    frame False, Default {
      call "niUSRP Close Session.gvi"(Handle in=$"USRP Session", error in (no error)=$"error in") -> (Error Out=w3)
    }
    frame True {
      w3 = $"error in"
    }
  }
  Release Queue(error in (no error)=w3, queue=w1) -> (error out=w4)
  $"error out" <- w4
