vi "receiver_apply_channel_MIMO (SubVI).gvi"   [LabVIEW NXG]
inputs:
  "Channel Model Parameters": T1 = {"Noise Power (dB)"=-Inf, "Channel Response RX 1"=[], "Frequency Offset"=0, "Delay (sec)"=0, "Channel Model"="AWGN", "Channel Response RX 2"=[]}
  "Input complex waveform 2": cluster{"t0": f64, "dt": f64, "Y": c128[]}
  "Modulation Parameters In": T7 = {"Modulation Type"="QPSK", "Control Information\nfor Packet Header/Tail"={"Training Sequence 1 (derived)"=[], "Zero Pad Length"=0, "Training Sequence 2 (derived)"=[]}, "RX Oversample Factor"=20, "Synchronization Options"={"Synchronization Method"="Timing Estimation", "Fixed Offset"=0, "Symbol Timing Recovery Method"="Max Energy", "Frame Detection Method"="Sliding Correlator", "Correct Frequency Offset"=FALSE}, "Number of Data Symbols (Derived)"=250, "RX Sample Rate"=4000000, "Pulse Shaping Parameters"={"Modulation Type"="PSK", "Pulse Shaping Filter"="Raised Cosine", "Filter Parameter"=0.5, "Filter Length (Symbols)"=8}, "Channel Estimation/Equalization Parameters"={"Equalization Method"="Direct", "Channel Estimate Length"=4, "Equalizer Length"=4, "Equalizer Delay"=-1}}
  "Input complex waveform 1": cluster{"t0": f64, "dt": f64, "Y": c128[]}
  "error in": error
outputs:
  "Modulation Parameters Out": T7
  "Output Complex Waveform 1": cluster{"t0": f64, "dt": f64, "Y": c128[]}
  "Actual Delay 2 (Sec)": f64
  "Actual Delay 1 (Sec)": f64
  "error out": error
  "Output Complex Waveform 2": cluster{"t0": f64, "dt": f64, "Y": c128[]}
types:
  T1 = cluster{"Noise Power (dB)": f64, "Channel Response RX 1": c128[], "Frequency Offset": f64, "Delay (sec)": f64, "Channel Model": string, "Channel Response RX 2": c128[]}
  T2 = cluster{"Training Sequence 1 (derived)": c128[], "Zero Pad Length": i32, "Training Sequence 2 (derived)": c128[]}
  T3 = cluster{"Synchronization Method": string, "Fixed Offset": i32, "Symbol Timing Recovery Method": string, "Frame Detection Method": string, "Correct Frequency Offset": bool}
  T4 = enum{"none", "Raised Cosine", "Root Raised Cos", "Gaussian"}
  T5 = cluster{"Modulation Type": enum{"FSK", "PSK", "QAM", "MSK", "PAM", "ASK"}, "Pulse Shaping Filter": T4, "Filter Parameter": f64, "Filter Length (Symbols)": i32}
  T6 = cluster{"Equalization Method": string, "Channel Estimate Length": i32, "Equalizer Length": i32, "Equalizer Delay": i32}
  T7 = cluster{"Modulation Type": string, "Control Information\nfor Packet Header/Tail": T2, "RX Oversample Factor": i32, "Synchronization Options": T3, "Number of Data Symbols (Derived)": i32, "RX Sample Rate": f64, "Pulse Shaping Parameters": T5, "Channel Estimation/Equalization Parameters": T6}
diagram:
  $"Modulation Parameters Out" <- $"Modulation Parameters In"
  call "channel_RX.gvi"(Modulation Parameters In=$"Modulation Parameters In", Input Complex Waveform=$"Input complex waveform 1", Receive antenna number=0, Channel Model Parameters=$"Channel Model Parameters", error in (no error)=$"error in") -> (Output Complex Waveform=w1, Actual Delay (Sec)=w2, error out=w3)
  $"Output Complex Waveform 1" <- w1
  $"Actual Delay 1 (Sec)" <- w2
  call "channel_RX.gvi"(Modulation Parameters In=$"Modulation Parameters In", Input Complex Waveform=$"Input complex waveform 2", Receive antenna number=1, Channel Model Parameters=$"Channel Model Parameters", error in (no error)=w3) -> (Output Complex Waveform=w4, Actual Delay (Sec)=w5, error out=w6)
  $"error out" <- w6
  $"Output Complex Waveform 2" <- w4
  $"Actual Delay 2 (Sec)" <- w5
