vi "receiver_generate_waveforms (SubVI).gvi"   [LabVIEW NXG]
inputs:
  "Modulation Parameters In": T8 = {"Modulation Type"="QPSK", "Control Information\nfor Packet Header/Tail"={"Training Sequence 1 (derived)"=[], "Zero Pad Length"=0, "Training Sequence 2 (derived)"=[]}, "RX Oversample Factor"=20, "Synchronization Options"={"Synchronization Method"="Timing Estimation", "Fixed Offset"=0, "Symbol Timing Recovery Method"="Max Energy", "Frame Detection Method"="Sliding Correlator", "Correct Frequency Offset"=FALSE}, "Number of Data Symbols (Derived)"=250, "RX Sample Rate"=4000000, "Pulse Shaping Parameters"={"Modulation Type"="PSK", "Pulse Shaping Filter"="Raised Cosine", "Filter Parameter"=0.5, "Filter Length (Symbols)"=8}, "Channel Estimation/Equalization Parameters"={"Equalization Method"="Direct", "Channel Estimate Length"=4, "Equalizer Length"=4, "Equalizer Delay"=-1}}
  "Intermediate Complex Waveform 1": cluster{"t0": f64, "dt": f64, "Y": c128[]} = {"t0"=0, "dt"=1, "Y"=[]}
  "Data Symbols": c128[]
  "Measured channel impairements": T10
  "Intermediate Complex Waveform 2": cluster{"t0": f64, "dt": f64, "Y": c128[]} = {"t0"=0, "dt"=1, "Y"=[]}
outputs:
  "Modulation Parameters Out": T8
  "RX Waveforms Out 1": T1
  "Power delay profiles": T11
  "RX Waveforms Out 2": T1
  "Received Constellation": T2[]
panel controls:
  "I/Q (I)": enum{"I", "Q"} = "I"
  "Eye Length": i32 = 2
  "Tab": i32
  "RX Waveforms In 1": T1 = {"Eye Diagram"=[], "Power Delay Profile 1"={dt=1, Y=[]}, "IQ Graph"=[], "Power Delay Profile 2"={dt=1, Y=[]}}
  "RX Waveforms In 2": T1 = {"Eye Diagram"=[], "Power Delay Profile 1"={dt=1, Y=[]}, "IQ Graph"=[], "Power Delay Profile 2"={dt=1, Y=[]}}
panel indicators:
  "Eye Diagram 1": cluster{"t0": f64, "dt": f64, "Y": f64[]}[]
types:
  T1 = cluster{"Eye Diagram": cluster{"t0": f64, "dt": f64, "Y": f64[]}[], "Power Delay Profile 1": DoubleAnalogWaveform, "IQ Graph": cluster{"Element 1": f64[], "Element 2": f64[]}[], "Power Delay Profile 2": DoubleAnalogWaveform}
  T2 = cluster{"constellation": f64[], "oversampled data": f64[]}
  T3 = cluster{"Training Sequence 1 (derived)": c128[], "Zero Pad Length": i32, "Training Sequence 2 (derived)": c128[]}
  T4 = cluster{"Synchronization Method": string, "Fixed Offset": i32, "Symbol Timing Recovery Method": string, "Frame Detection Method": string, "Correct Frequency Offset": bool}
  T5 = enum{"none", "Raised Cosine", "Root Raised Cos", "Gaussian"}
  T6 = cluster{"Modulation Type": enum{"FSK", "PSK", "QAM", "MSK", "PAM", "ASK"}, "Pulse Shaping Filter": T5, "Filter Parameter": f64, "Filter Length (Symbols)": i32}
  T7 = cluster{"Equalization Method": string, "Channel Estimate Length": i32, "Equalizer Length": i32, "Equalizer Delay": i32}
  T8 = cluster{"Modulation Type": string, "Control Information\nfor Packet Header/Tail": T3, "RX Oversample Factor": i32, "Synchronization Options": T4, "Number of Data Symbols (Derived)": i32, "RX Sample Rate": f64, "Pulse Shaping Parameters": T6, "Channel Estimation/Equalization Parameters": T7}
  T9 = cluster{"Element 1": c128[], "Element 2": c128[], "Element 3": c128[], "Element 4": c128[]}
  T10 = cluster{"SNR(dB)": f64, "freq. offset 1": f64, "delay 1": f64, "Channel estimates": T9, "freq. offset 2": f64, "delay 2": f64}
  T11 = cluster{"Element 1": DoubleAnalogWaveform, "Element 2": DoubleAnalogWaveform, "Element 3": DoubleAnalogWaveform, "Element 4": DoubleAnalogWaveform}
diagram:
  Property Node(instance in=$"Modulation Parameters In") -> ("RX Sample Rate"=w1, "RX Oversample Factor"=w2)
  Divide(x=w1, y=w2) -> w3
  Reciprocal(x=w3) -> w4
  call "make_MTwaveform.gvi"(dt=w4, Y=$"Data Symbols") -> (output MT waveform=w5)
  call "MT Format Constellation.gvi"(waveform=w5) -> (constellation graph=w6)
  $"Received Constellation" <- w6
  $"Modulation Parameters Out" <- $"Modulation Parameters In"
  # w3: symbol rate
  call "MT Format Eye Diagram (complex).gvi"(waveform=$"Intermediate Complex Waveform 1", symbol rate=w3, eye length=$"Eye Length", I/Q=$"I/Q (I)") -> (eye diagram=w7)
  Property Node(instance in=$"Measured channel impairements") -> ("Channel estimates:Element 1"=w8, "Channel estimates:Element 2"=w9, "Channel estimates:Element 3"=w10, "Channel estimates:Element 4"=w11)
  call "Upsample (CDB).gvi"(x=w8, upsampling factor=w2) -> (upsampled array=w12)
  Reciprocal(x=w1) -> w13
  call "make_MTwaveform.gvi"(dt=w13, Y=w12) -> (output MT waveform=w14)
  call "MT Get Complex IQ Component.gvi"(IQ data in=w14, component choice="Magnitude") -> (CE component=w15)
  Property Node(instance in=w15) -> ("Y"=w16, "t0"=w17, "dt"=w18)
  Square(x=w16) -> w19
  Build Waveform Node(Y=w19, dt=w18, t0=w17) -> (output waveform=w20)
  call "Upsample (CDB).gvi"(x=w9, upsampling factor=w2) -> (upsampled array=w21)
  Reciprocal(x=w1) -> w22
  call "make_MTwaveform.gvi"(dt=w22, Y=w21) -> (output MT waveform=w23)
  call "MT Get Complex IQ Component.gvi"(IQ data in=w23, component choice="Magnitude") -> (CE component=w24)
  Property Node(instance in=w24) -> ("Y"=w25, "t0"=w26, "dt"=w27)
  Square(x=w25) -> w28
  Build Waveform Node(Y=w28, dt=w27, t0=w26) -> (output waveform=w29)
  Property Node(instance in=$"RX Waveforms In 1", "IQ Graph"=w6, "Eye Diagram"=w7, "Power Delay Profile 1"=w20, "Power Delay Profile 2"=w29) -> (instance out=w30)
  $"RX Waveforms Out 1" <- w30
  $"Eye Diagram 1" <- w7
  call "MT Format Eye Diagram (complex).gvi"(waveform=$"Intermediate Complex Waveform 2", symbol rate=w3, eye length=$"Eye Length", I/Q=$"I/Q (I)") -> (eye diagram=w31)
  call "Upsample (CDB).gvi"(x=w11, upsampling factor=w2) -> (upsampled array=w32)
  Reciprocal(x=w1) -> w33
  call "make_MTwaveform.gvi"(dt=w33, Y=w32) -> (output MT waveform=w34)
  call "MT Get Complex IQ Component.gvi"(IQ data in=w34, component choice="Magnitude") -> (CE component=w35)
  Property Node(instance in=w35) -> ("Y"=w36, "t0"=w37, "dt"=w38)
  Square(x=w36) -> w39
  Build Waveform Node(Y=w39, dt=w38, t0=w37) -> (output waveform=w40)
  call "Upsample (CDB).gvi"(x=w10, upsampling factor=w2) -> (upsampled array=w41)
  Reciprocal(x=w1) -> w42
  call "make_MTwaveform.gvi"(dt=w42, Y=w41) -> (output MT waveform=w43)
  call "MT Get Complex IQ Component.gvi"(IQ data in=w43, component choice="Magnitude") -> (CE component=w44)
  Property Node(instance in=w44) -> ("Y"=w45, "t0"=w46, "dt"=w47)
  Square(x=w45) -> w48
  Build Waveform Node(Y=w48, dt=w47, t0=w46) -> (output waveform=w49)
  Property Node(instance in=$"RX Waveforms In 2", "IQ Graph"=w6, "Eye Diagram"=w31, "Power Delay Profile 1"=w49, "Power Delay Profile 2"=w40) -> (instance out=w50)
  $"RX Waveforms Out 2" <- w50
  Build Cluster(w20, w29, w49, w40) -> w51
  $"Power delay profiles" <- w51
