vi "RXRF_config_MIMO.gvi"   [LabVIEW NXG]
inputs:
  "HW Parameters In": T1 = {"Active Antenna"="RX1", "Carrier Frequency (Hz)"=915000000, "Gain (dB)"=10, "Trigger Level"=0.01, "Bandwidth (Hz)"=915000000, "Reference Position (%)"=10, "Capture Time (s)"=0.0033, "Simulate"=FALSE, "Device IP Address"="192.168.10.2"}
  "USRP Session In": niUSRP
  "queue in": cluster{"Key Bit Sequence": Queue<u8[]>}
  "Modulation Parameters In": T7 = {"Modulation Type"="QPSK", "Control Information\nfor Packet Header/Tail"={"Training Sequence 1 (derived)"=[], "Zero Pad Length"=0, "Training Sequence 2 (derived)"=[]}, "RX Oversample Factor"=20, "Synchronization Options"={"Synchronization Method"="Timing Estimation", "Fixed Offset"=0, "Symbol Timing Recovery Method"="Max Energy", "Frame Detection Method"="Sliding Correlator", "Correct Frequency Offset"=FALSE}, "Number of Data Symbols (Derived)"=100, "RX Sample Rate"=4000000, "Pulse Shaping Parameters"={"Modulation Type"="PSK", "Pulse Shaping Filter"="Root Raised Cos", "Filter Parameter"=0.5, "Filter Length (Symbols)"=8}, "Channel Estimation/Equalization Parameters"={"Equalization Method"="Direct", "Channel Estimate Length"=1, "Equalizer Length"=1, "Equalizer Delay"=-1}}
  "error in (no error)": error
outputs:
  "HW Parameters Out": T1
  "Modulation Parameters Out": T7
  "Simulate": bool
  "queue out": cluster{"Key Bit Sequence": Queue<u8[]>}
  "error out": error
  "USRP Session Out": niUSRP
  "Coerced Carrier Frequency (Hz)": f64
  "Coerced Bandwidth": f64
  "Coerced Gain (dB)": f64
types:
  T1 = cluster{"Active Antenna": string, "Carrier Frequency (Hz)": f64, "Gain (dB)": f64, "Trigger Level": f64, "Bandwidth (Hz)": f64, "Reference Position (%)": f64, "Capture Time (s)": f64, "Simulate": bool, "Device IP Address": string}
  T2 = cluster{"Training Sequence 1 (derived)": c128[], "Zero Pad Length": i32, "Training Sequence 2 (derived)": c128[]}
  T3 = cluster{"Synchronization Method": string, "Fixed Offset": i32, "Symbol Timing Recovery Method": string, "Frame Detection Method": string, "Correct Frequency Offset": bool}
  T4 = enum{"none", "Raised Cosine", "Root Raised Cos", "Gaussian"}
  T5 = cluster{"Modulation Type": enum{"FSK", "PSK", "QAM", "MSK", "PAM", "ASK"}, "Pulse Shaping Filter": T4, "Filter Parameter": f64, "Filter Length (Symbols)": i32}
  T6 = cluster{"Equalization Method": string, "Channel Estimate Length": i32, "Equalizer Length": i32, "Equalizer Delay": i32}
  T7 = cluster{"Modulation Type": string, "Control Information\nfor Packet Header/Tail": T2, "RX Oversample Factor": i32, "Synchronization Options": T3, "Number of Data Symbols (Derived)": i32, "RX Sample Rate": f64, "Pulse Shaping Parameters": T5, "Channel Estimation/Equalization Parameters": T6}
  T8 = cluster{"whole seconds": u64, "fractional seconds": f64}
diagram:
  $"queue out" <- $"queue in"
  $"Modulation Parameters Out" <- $"Modulation Parameters In"
  $"HW Parameters Out" <- $"HW Parameters In"
  case ($"error in (no error)") {
    frame No Error {
      Property Node(instance in=$"HW Parameters In") -> ("Simulate"=w2)
      case (w2) {
        frame False, Default {
          Property Node(instance in=$"HW Parameters In") -> ("Carrier Frequency (Hz)"=w3, "Gain (dB)"=w4, "Active Antenna"=w5, "Bandwidth (Hz)"=w6)
          Property Node(instance in=$"Modulation Parameters In") -> ("RX Sample Rate"=w7)
          Property Node(instance in=$"USRP Session In", error in=$"error in (no error)", "Configuration:IQ Rate"=w7, "Configuration:Carrier Frequency"=w3) -> (instance out=w8, error out=w9, "Configuration:Carrier Frequency"=w10)
          Property Node(instance in=w8, error in=w9, "Active Channel"="0", "Configuration:Gain"=w4, "Configuration:Active Antenna"=w5, "Clocking and Synchronization:Reference Frequency Source"="Internal", "Clocking and Synchronization:Timebase Clock Source"="Internal") -> (instance out=w11, error out=w12)
          Property Node(instance in=w11, error in=w12, "Active Channel"="1", "Configuration:Gain"=w4, "Configuration:Active Antenna"=w5, "Clocking and Synchronization:Reference Frequency Source"="Mimo", "Clocking and Synchronization:Timebase Clock Source"="Mimo") -> (instance out=w13, error out=w14, "Configuration:Gain"=w15)
          call "niUSRP Set Time.gvi"(session handle=w13, timestamp=T8 {all zero or empty}, error in (no error)=w14, channel list="0,1") -> (session handle out=w16, Error Out=w17)
          call "niUSRP Configure Time Start Trigger.gvi"(session handle=w16, start trigger time=T8 {"whole seconds"=0, "fractional seconds"=0.1}, error in (no error)=w17) -> (session handle out=w18, Error Out=w1)
          $"USRP Session Out" <- w18
          $"Coerced Carrier Frequency (Hz)" <- w10
          $"Coerced Bandwidth" <- w6
          $"Coerced Gain (dB)" <- w15
        }
        frame True {
          w1 = $"error in (no error)"
        }
      }
      $Simulate <- w2
    }
    frame Error {
      w1 = $"error in (no error)"
    }
  }
  $"error out" <- w1
