vi "RXRF_recv_MIMO.gvi"   [LabVIEW NXG]
inputs:
  "USRP Session In": niUSRP
  "HW Parameters In": T1 = {"Active Antenna"="RX1", "Carrier Frequency (Hz)"=915000000, "Gain (dB)"=10, "Trigger Level"=0.01, "Bandwidth (Hz)"=915000000, "Reference Position (%)"=10, "Capture Time (s)"=0.0033, "Simulate"=FALSE, "Device IP Address"="192.168.10.2"}
  "Modulation Parameters In": T7 = {"Modulation Type"="QPSK", "Control Information\nfor Packet Header/Tail"={"Training Sequence 1 (derived)"=[], "Zero Pad Length"=0, "Training Sequence 2 (derived)"=[]}, "RX Oversample Factor"=20, "Synchronization Options"={"Synchronization Method"="Timing Estimation", "Fixed Offset"=0, "Symbol Timing Recovery Method"="Max Energy", "Frame Detection Method"="Sliding Correlator", "Correct Frequency Offset"=FALSE}, "Number of Data Symbols (Derived)"=100, "RX Sample Rate"=4000000, "Pulse Shaping Parameters"={"Modulation Type"="PSK", "Pulse Shaping Filter"="Root Raised Cos", "Filter Parameter"=0.5, "Filter Length (Symbols)"=8}, "Channel Estimation/Equalization Parameters"={"Equalization Method"="Direct", "Channel Estimate Length"=1, "Equalizer Length"=1, "Equalizer Delay"=-1}}
  "error in (no error)": error
  "queue in": cluster{"Key Bit Sequence": Queue<u8[]>}
outputs:
  "Packet Detected": bool
  "USRP Session Out": niUSRP
  "Modulation Parameters Out": T7
  "HW Parameters Out": T1
  "error out": error
  "Received IQ waveform 1": cluster{"t0": f64, "dt": f64, "Y": c128[]}
  "queue out": cluster{"Key Bit Sequence": Queue<u8[]>}
  "Received IQ waveform 2": cluster{"t0": f64, "dt": f64, "Y": c128[]}
types:
  T1 = cluster{"Active Antenna": string, "Carrier Frequency (Hz)": f64, "Gain (dB)": f64, "Trigger Level": f64, "Bandwidth (Hz)": f64, "Reference Position (%)": f64, "Capture Time (s)": f64, "Simulate": bool, "Device IP Address": string}
  T2 = cluster{"Training Sequence 1 (derived)": c128[], "Zero Pad Length": i32, "Training Sequence 2 (derived)": c128[]}
  T3 = cluster{"Synchronization Method": string, "Fixed Offset": i32, "Symbol Timing Recovery Method": string, "Frame Detection Method": string, "Correct Frequency Offset": bool}
  T4 = enum{"none", "Raised Cosine", "Root Raised Cos", "Gaussian"}
  T5 = cluster{"Modulation Type": enum{"FSK", "PSK", "QAM", "MSK", "PAM", "ASK"}, "Pulse Shaping Filter": T4, "Filter Parameter": f64, "Filter Length (Symbols)": i32}
  T6 = cluster{"Equalization Method": string, "Channel Estimate Length": i32, "Equalizer Length": i32, "Equalizer Delay": i32}
  T7 = cluster{"Modulation Type": string, "Control Information\nfor Packet Header/Tail": T2, "RX Oversample Factor": i32, "Synchronization Options": T3, "Number of Data Symbols (Derived)": i32, "RX Sample Rate": f64, "Pulse Shaping Parameters": T5, "Channel Estimation/Equalization Parameters": T6}
diagram:
  $"queue out" <- $"queue in"
  $"Modulation Parameters Out" <- $"Modulation Parameters In"
  $"HW Parameters Out" <- $"HW Parameters In"
  case ($"error in (no error)") {
    frame No Error {
      Property Node(instance in=$"HW Parameters In") -> ("Capture Time (s)"=w2, "Trigger Level"=w3, "Reference Position (%)"=w4)
      call "niUSRP Initiate.gvi"(session handle=$"USRP Session In", error in (no error)=$"error in (no error)") -> (session handle out=w5, Error Out=w6)
      # Initiate capture
      Property Node(instance in=$"Modulation Parameters In") -> ("RX Sample Rate"=w7)
      Multiply(w7, w2) -> w8
      Round To Nearest(number=w8) -> w9
      call "RXRF_trigger_and_capture_MIMO.gvi"(USRP Session In=w5, trigger level=w3, Reference Position=w4, error in (no error)=w6, number of samples=w9) -> (USRP Session out=w10, IQ Waveform_2=w11, IQ Waveform=w12, packet found=w13, error out=w14)
      $"Received IQ waveform 1" <- w12
      # stop capture so that
      # other processing can occur
      $"Received IQ waveform 2" <- w11
      call "niUSRP Abort.gvi"(Handle in=w10, error in (no error)=w14) -> (Handle out=w15, Error Out=w1)
      $"USRP Session Out" <- w15
      # packet detected if no error occurs and
      # the receiver did not timeout
      $"Packet Detected" <- TRUE
      Property Node(instance in=w1) -> ("code"=w16)
      Is Equal To 0(x=w16) -> w17
      Logical And(w17, w13)
    }
    frame Error {
      w1 = $"error in (no error)"
    }
  }
  $"error out" <- w1
