vi "TXRF_prepare_for_transmit_MIMO.gvi"   [LabVIEW NXG]
inputs:
  "IQ Data_2": cluster{"t0": f64, "dt": f64, "Y": c128[]}
  "IQ Data": cluster{"t0": f64, "dt": f64, "Y": c128[]}
  "error in": error
outputs:
  "Scaled and Padded IQ Data_2": cluster{"t0": f64, "dt": f64, "Y": c128[]}
  "Scaled and Padded IQ Data": cluster{"t0": f64, "dt": f64, "Y": c128[]}
  "error out": error
diagram:
  $"error out" <- $"error in"
  Property Node(instance in=$"IQ Data") -> ("Y"=w1)
  Complex To Polar(r * e^(i*theta)=w1) -> (r=w2)
  # make sure IQ data does not go over 1,
  # otherwise a digital overflow will occur
  Array Max And Min(array=w2) -> (max value=w3)
  Divide(x=w1, y=w3) -> w4
  Array Size(array=w4) -> (size(s)=w5)
  Multiply(w5, 2) -> w6
  Initialize Array(element=0, size=w6) -> w7
  Insert Into Array(inArray=w4, index0=0, new=w7) -> w8
  Initialize Array(element=0, size=200) -> w9
  Build Array[ConcatenateInputs=True](w8, w9) -> w10
  Property Node(instance in=$"IQ Data", "Y"=w10) -> (instance out=w11)
  $"Scaled and Padded IQ Data" <- w11
  Property Node(instance in=$"IQ Data_2") -> ("Y"=w12)
  Complex To Polar(r * e^(i*theta)=w12) -> (r=w13)
  # make sure IQ data does not go over 1,
  # otherwise a digital overflow will occur
  Array Max And Min(array=w13) -> (max value=w14)
  Divide(x=w12, y=w14) -> w15
  Array Size(array=w15) -> (size(s)=w16)
  Multiply(w16, 2) -> w17
  Initialize Array(element=0, size=w17) -> w18
  Insert Into Array(inArray=w15, index0=0, new=w18) -> w19
  Initialize Array(element=0, size=200) -> w20
  Build Array[ConcatenateInputs=True](w19, w20) -> w21
  Property Node(instance in=$"IQ Data_2", "Y"=w21) -> (instance out=w22)
  $"Scaled and Padded IQ Data_2" <- w22
