vi "Alamouti_RX_student_OFDM.gvi"   [LabVIEW NXG]
inputs:
  "Modulation Parameters In": T6 = {"Modulation Type"="QPSK", "Control Information\nfor Packet Header/Tail"={"Training Sequence 1 (derived)"=[], "Zero Pad Length"=0, "Training Sequence 2 (derived)"=[]}, "RX Oversample Factor"=20, "Synchronization Options"={"Synchronization Method"="Timing Estimation", "Fixed Offset"=0, "Symbol Timing Recovery Method"="Max Energy", "Frame Detection Method"="Sliding Correlator", "Correct Frequency Offset"=FALSE}, "Number of Data Symbols (Derived)"=250, "RX Sample Rate"=4000000, "Pulse Shaping Parameters"={"Modulation Type"="PSK", "Pulse Shaping Filter"="Raised Cosine", "Filter Parameter"=0.5, "Filter Length (Symbols)"=8}, "Channel Estimation/Equalization Parameters"={"Equalization Method"="Direct", "Channel Estimate Length"=4, "Equalizer Length"=4, "Equalizer Delay"=-1}}
  "Input Complex Symbols 1": c128[]
  "Input Complex Symbols 2": c128[]
  "Channel estimates": T7
  "error in (no error)": error
  "OFDM Parameters In": T8 = {"FFT size (N)"=64, "Length of CP (Lc)"=8, "Null Tones"=[], "Number of OFDM Symbols (derived)"=1, "Training Sequence FFT size"=0, "Training Sequence Length of CP"=0, "Number of null tones"=0}
outputs:
  "Output Complex Symbols": c128[]
  "Modulation Parameters Out": T6
  "error out": error
panel indicators:
  "FFT size (N)": i32
types:
  T1 = cluster{"Training Sequence 1 (derived)": c128[], "Zero Pad Length": i32, "Training Sequence 2 (derived)": c128[]}
  T2 = cluster{"Synchronization Method": string, "Fixed Offset": i32, "Symbol Timing Recovery Method": string, "Frame Detection Method": string, "Correct Frequency Offset": bool}
  T3 = enum{"none", "Raised Cosine", "Root Raised Cos", "Gaussian"}
  T4 = cluster{"Modulation Type": enum{"FSK", "PSK", "QAM", "MSK", "PAM", "ASK"}, "Pulse Shaping Filter": T3, "Filter Parameter": f64, "Filter Length (Symbols)": i32}
  T5 = cluster{"Equalization Method": string, "Channel Estimate Length": i32, "Equalizer Length": i32, "Equalizer Delay": i32}
  T6 = cluster{"Modulation Type": string, "Control Information\nfor Packet Header/Tail": T1, "RX Oversample Factor": i32, "Synchronization Options": T2, "Number of Data Symbols (Derived)": i32, "RX Sample Rate": f64, "Pulse Shaping Parameters": T4, "Channel Estimation/Equalization Parameters": T5}
  T7 = cluster{"Element 1": c128[], "Element 2": c128[], "Element 3": c128[], "Element 4": c128[]}
  T8 = cluster{"FFT size (N)": i32, "Length of CP (Lc)": i32, "Null Tones": u32[], "Number of OFDM Symbols (derived)": i32, "Training Sequence FFT size": i32, "Training Sequence Length of CP": i32, "Number of null tones": i32}
diagram:
  Build Array(1+0i, 0.5+0i)
  Array Size(array=$"Input Complex Symbols 1") -> (size(s)=w1)
  Divide(x=w1, y=2) -> w2
  Property Node(instance in=$"OFDM Parameters In") -> ("FFT size (N)"=w3)
  Divide(x=w1, y=w3) -> w4
  Reshape Array(inArray=$"Input Complex Symbols 1", size=w4, size=w3) -> w5
  for (N = w4) (iteration -> i1) {
    Multiply(2, i1) -> w8
    Array Index(array=w5) -> (out0[w8, _]=w9)
    Multiply(2, i1) -> w10
    Increment(x=w10) -> w11
    Array Index(array=w5) -> (out0[w11, _]=w12)
    append w9 to w6
    append w12 to w7
  }
  # R1[k],R5[k]
  # R2[k], R6[k]
  Reshape Array(inArray=w7, size=w2) -> w13
  # R0[k],R4[k]
  Complex Conjugate(x + iy=w13) -> w14
  Property Node(instance in=$"Channel estimates") -> ("Element 1"=w15, "Element 2"=w16, "Element 3"=w17, "Element 4"=w18)
  call "Complex FFT.gvi"(x=w16, shift?=FALSE, FFT size=w3) -> (FFT {x}=w19)
  Array Size(array=w14) -> (size(s)=w20)
  Divide(x=w20, y=w3) -> w21
  call "Repeat.gvi"(Array=w19, Numeric=w21) -> (output array=w22)
  Multiply(w22, w14) -> w23
  Array Size(array=$"Input Complex Symbols 2") -> (size(s)=w24)
  Divide(x=w24, y=2) -> w25
  Divide(x=w24, y=w3) -> w26
  Reshape Array(inArray=$"Input Complex Symbols 2", size=w26, size=w3) -> w27
  for (N = w26) (iteration -> i2) {
    Multiply(2, i2) -> w30
    Array Index(array=w27) -> (out0[w30, _]=w31)
    Multiply(2, i2) -> w32
    Increment(x=w32) -> w33
    Array Index(array=w27) -> (out0[w33, _]=w34)
    append w34 to w28
    append w31 to w29
  }
  Reshape Array(inArray=w29, size=w25) -> w35
  call "Complex FFT.gvi"(x=w17, shift?=FALSE, FFT size=w3) -> (FFT {x}=w36)
  # H1[k]*
  # H2[k]*
  Complex Conjugate(x + iy=w36) -> w37
  Array Size(array=w35) -> (size(s)=w38)
  Divide(x=w38, y=w3) -> w39
  call "Repeat.gvi"(Array=w37, Numeric=w39) -> (output array=w40)
  Multiply(w40, w35) -> w41
  Reshape Array(inArray=w6, size=w2) -> w42
  call "Complex FFT.gvi"(x=w15, shift?=FALSE, FFT size=w3) -> (FFT {x}=w43)
  # Ho[k]*
  Complex Conjugate(x + iy=w43) -> w44
  Array Size(array=w42) -> (size(s)=w45)
  Divide(x=w45, y=w3) -> w46
  call "Repeat.gvi"(Array=w44, Numeric=w46) -> (output array=w47)
  # (R0[k] R4[k])H0*[k]
  Multiply(w47, w42) -> w48
  # R3[k],R7[k]
  Reshape Array(inArray=w28, size=w25) -> w49
  Complex Conjugate(x + iy=w49) -> w50
  call "Complex FFT.gvi"(x=w18, shift?=FALSE, FFT size=w3) -> (FFT {x}=w51)
  Array Size(array=w50) -> (size(s)=w52)
  Divide(x=w52, y=w3) -> w53
  call "Repeat.gvi"(Array=w51, Numeric=w53) -> (output array=w54)
  # (R3*[k] R7*[k])H3[k]
  Multiply(w54, w50) -> w55
  # ~s0,~s2,~s4
  # (R1*[k] R5*[k])H1[k]
  # (R2[k] R6[k])H2*[k]
  Add(w48, w23, w41, w55) -> w56
  Array Size(array=w14) -> (size(s)=w57)
  Divide(x=w57, y=w3) -> w58
  call "Repeat.gvi"(Array=w43, Numeric=w58) -> (output array=w59)
  Multiply(w59, w14, -1+0i) -> w60
  # H3[k]*
  Complex Conjugate(x + iy=w51) -> w61
  Array Size(array=w35) -> (size(s)=w62)
  Divide(x=w62, y=w3) -> w63
  call "Repeat.gvi"(Array=w61, Numeric=w63) -> (output array=w64)
  Multiply(w64, w35) -> w65
  Array Size(array=w50) -> (size(s)=w66)
  Divide(x=w66, y=w3) -> w67
  call "Repeat.gvi"(Array=w36, Numeric=w67) -> (output array=w68)
  Multiply(w68, w50, -1+0i) -> w69
  Complex Conjugate(x + iy=w19) -> w70
  Array Size(array=w42) -> (size(s)=w71)
  Divide(x=w71, y=w3) -> w72
  call "Repeat.gvi"(Array=w70, Numeric=w72) -> (output array=w73)
  Multiply(w73, w42) -> w74
  # (R0[k] R4[k])H1*[k]
  # -(R1*[k] R5*[k])H0[k]
  # (R2[k] R6[k])H3*[k]
  # -(R3*[k] R7*[k])H2[k]
  Add(w74, w60, w65, w69) -> w75
  # ~s1,~s3,~s5
  Interleave Array(w56, w75) -> w76
  # a0[k]
  Absolute Value(x=w43) -> w77
  Square(x=w77) -> w78
  # a1[k]
  Absolute Value(x=w19) -> w79
  Square(x=w79) -> w80
  Absolute Value(x=w36) -> w81
  # a2[k]
  Square(x=w81) -> w82
  Absolute Value(x=w51) -> w83
  # a3[k]
  Square(x=w83) -> w84
  Add(w78, w80, w82, w84) -> w85
  Interleave Array(w85, w85) -> w86
  Array Size(array=w76) -> (size(s)=w87)
  Divide(x=w87, y=w3) -> w88
  call "Repeat.gvi"(Array=w86, Numeric=w88) -> (output array=w89)
  Divide(x=w76, y=w89) -> w90
  $"Output Complex Symbols" <- w90
  $"error out" <- $"error in (no error)"
  $"FFT size (N)" <- w3
  $"Modulation Parameters Out" <- $"Modulation Parameters In"
