vi "Alamouti_TX_student_OFDM.gvi"   [LabVIEW NXG]
inputs:
  "input symbols": c128[] = [1+0i, 2+0i, 3+0i, 4+0i, 0.707106781187+0.707106781187i, -0.707106781187+0.707106781187i, 0.707106781187+0.707106781187i, -0.707106781187-0.707106781187i, -0.707106781187+0.707106781187i, 0.707106781187+0.707106781187i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]
  "OFDM Parameters In": T7 = {"FFT size (N)"=64, "Length of CP (Lc)"=8, "Null Tones"=[0, 30, 31, 32], "Number of OFDM Symbols (derived)"=1, "Training Sequence FFT size"=0, "Training Sequence Length of CP"=0, "Number of null tones"=0}
  "Modulation Parameters In": T4 = {"Modulation Type"="QPSK", "Pulse Shaping Parameters"={"Modulation Type"="PSK", "Pulse Shaping Filter"="Raised Cosine", "Filter Parameter"=0.5, "Filter Length (Symbols)"=8}, "TX Oversample Factor"=20, "Packet Length (Bits)"=500, "TX Sample Rate"=100, "Control Information For Packet Header/Tail"={"Training Sequences"="Length 11 Barker Sequence", "Zero Pad Length"=8}}
  "error in (no error)": error
outputs:
  "Modulation Parameters Out": T6
  "output 1": c128[]
  "output 2": c128[]
  "error out": error
types:
  T1 = enum{"none", "Raised Cosine", "Root Raised Cos", "Gaussian"}
  T2 = cluster{"Modulation Type": enum{"FSK", "PSK", "QAM", "MSK", "PAM", "ASK"}, "Pulse Shaping Filter": T1, "Filter Parameter": f64, "Filter Length (Symbols)": i32}
  T3 = cluster{"Training Sequences": string, "Zero Pad Length": i32}
  T4 = cluster{"Modulation Type": string, "Pulse Shaping Parameters": T2, "TX Oversample Factor": i32, "Packet Length (Bits)": i32, "TX Sample Rate": f64, "Control Information For Packet Header/Tail": T3}
  T5 = cluster{"Training Sequences ": string, "Zero Pad Length": i32}
  T6 = cluster{"Modulation Type": string, "Pulse Shaping Parameters": T2, "TX Oversample Factor": i32, "Packet Length (Bits)": i32, "TX Sample Rate": f64, "Control Information For Packet Header/Tail": T5}
  T7 = cluster{"FFT size (N)": i32, "Length of CP (Lc)": i32, "Null Tones": u32[], "Number of OFDM Symbols (derived)": i32, "Training Sequence FFT size": i32, "Training Sequence Length of CP": i32, "Number of null tones": i32}
diagram:
  case ($"error in (no error)") {
    frame No Error {
      Property Node(instance in=$"OFDM Parameters In") -> ("FFT size (N)"=w2)
      # s1
      Decimate Array(array=$"input symbols") -> (out0=w3, out1=w4)
      # antenna 0
      Complex Conjugate(x + iy=w4) -> w5
      # s0
      # -s1*
      Multiply(w5, -1) -> w6
      Array Size(array=w3) -> (size(s)=w7)
      Divide(x=w7, y=w2) -> w8
      Round Toward Positive Infinity(x=w8) -> w9
      for (N = w9) (iteration -> i1) {
        Multiply(w2, i1) -> w11
        Array Subset(array=w6, index0=w11, length0=w2) -> w12
        Array Subset(array=w3, index0=w11, length0=w2) -> w13
        Build Array(w13, w12) -> w14
        append w14 to w10
      }
      Multiply(2, w2, w9) -> w15
      # [64de s0, 128 de -s1*, etc...]
      Reshape Array(inArray=w10, size=w15) -> w16
      $"output 1" <- w16
      # antenna 1
      # s1
      # s0*
      Complex Conjugate(x + iy=w3) -> w17
      Array Size(array=w4) -> (size(s)=w18)
      Divide(x=w18, y=w2) -> w19
      Round Toward Positive Infinity(x=w19) -> w20
      for (N = w20) (iteration -> i2) {
        Multiply(w2, i2) -> w22
        Array Subset(array=w4, index0=w22, length0=w2) -> w23
        Array Subset(array=w17, index0=w22, length0=w2) -> w24
        Build Array(w23, w24) -> w25
        append w25 to w21
      }
      Multiply(w20, 2, w2) -> w26
      Reshape Array(inArray=w21, size=w26) -> w27
      # [64de s1, 128 de s0*, etc ...]
      $"output 2" <- w27
      w1 = $"error in (no error)"
    }
    frame Error {
      w1 = $"error in (no error)"
    }
  }
  $"error out" <- w1
  $"Modulation Parameters Out" <- $"Modulation Parameters In"
