vi "add_freq_offset.gvi"   [LabVIEW NXG]
inputs:
  "input": c128[]
  "symbol rate (Hz)": f64 = 100000000
  "frequency offset": f64
  "samples per symbol": i32 = 1
outputs:
  "output": c128[]
diagram:
  # Apply frequency offset
  Reciprocal(x=$"symbol rate (Hz)") -> w1
  Reciprocal(x=$"samples per symbol") -> w2
  Array Size(array=$input) -> (size(s)=w3)
  Decrement(x=w3) -> w4
  call "Ramp Pattern by Samples.gvi"(samples=w3, end=w4, start=0) -> (ramp pattern=w5)
  Multiply(PiTimes2, w1, $"frequency offset", w2, w5) -> w6
  # 2*pi*Ts*f_offset*n
  Polar To Complex(r=1, theta=w6) -> (r * e^(i*theta)=w7)
  Multiply(w7, $input) -> w8
  $output <- w8
