vi "receiver_channel_impairments_MIMO (SubVI).gvi"   [LabVIEW NXG]
inputs:
  "Modulation Parameters In": T8 = {"Modulation Type"="QPSK", "Control Information\nfor Packet Header/Tail"={"Training Sequence 1 (derived)"=[], "Zero Pad Length"=0, "Training Sequence 2 (derived)"=[]}, "RX Oversample Factor"=20, "Synchronization Options"={"Synchronization Method"="Timing Estimation", "Fixed Offset"=0, "Symbol Timing Recovery Method"="Max Energy", "Frame Detection Method"="Sliding Correlator", "Correct Frequency Offset"=FALSE}, "Number of Data Symbols (Derived)"=250, "RX Sample Rate"=4000000, "Pulse Shaping Parameters"={"Modulation Type"="PSK", "Pulse Shaping Filter"="Raised Cosine", "Filter Parameter"=0.5, "Filter Length (Symbols)"=8}, "Channel Estimation/Equalization Parameters"={"Equalization Method"="Direct", "Channel Estimate Length"=4, "Equalizer Length"=4, "Equalizer Delay"=-1}}
  "mean-squared error": f64
  "Channel estimates": T1
  "offset 1": i32
  "estimated frequency offset 1": f64
  "offset 2": i32
  "overhead offset": i32
  "estimated frequency offset 2": f64
outputs:
  "Measured channel impairements": T2
panel indicators:
  "Modulation Parameters Out": T8
types:
  T1 = cluster{"Element 1": c128[], "Element 2": c128[], "Element 3": c128[], "Element 4": c128[]}
  T2 = cluster{"SNR(dB)": f64, "freq. offset 1": f64, "delay 1": f64, "Channel estimates": T1, "freq. offset 2": f64, "delay 2": f64}
  T3 = cluster{"Training Sequence 1 (derived)": c128[], "Zero Pad Length": i32, "Training Sequence 2 (derived)": c128[]}
  T4 = cluster{"Synchronization Method": string, "Fixed Offset": i32, "Symbol Timing Recovery Method": string, "Frame Detection Method": string, "Correct Frequency Offset": bool}
  T5 = enum{"none", "Raised Cosine", "Root Raised Cos", "Gaussian"}
  T6 = cluster{"Modulation Type": enum{"FSK", "PSK", "QAM", "MSK", "PAM", "ASK"}, "Pulse Shaping Filter": T5, "Filter Parameter": f64, "Filter Length (Symbols)": i32}
  T7 = cluster{"Equalization Method": string, "Channel Estimate Length": i32, "Equalizer Length": i32, "Equalizer Delay": i32}
  T8 = cluster{"Modulation Type": string, "Control Information\nfor Packet Header/Tail": T3, "RX Oversample Factor": i32, "Synchronization Options": T4, "Number of Data Symbols (Derived)": i32, "RX Sample Rate": f64, "Pulse Shaping Parameters": T6, "Channel Estimation/Equalization Parameters": T7}
diagram:
  Reciprocal(x=$"mean-squared error") -> w1
  Logarithm Base 10(x=w1) -> w2
  Multiply(10, w2) -> w3
  Property Node(instance in=$"Modulation Parameters In") -> ("RX Sample Rate"=w4)
  Subtract(x=$"offset 1", y=$"overhead offset") -> w5
  Divide(x=w5, y=w4) -> w6
  Subtract(x=$"offset 2", y=$"overhead offset") -> w7
  Divide(x=w7, y=w4) -> w8
  Property Node(instance in=$"Measured channel impairements", "Channel estimates"=$"Channel estimates", "SNR(dB)"=w3, "freq. offset 1"=$"estimated frequency offset 1", "freq. offset 2"=$"estimated frequency offset 2", "delay 1"=w6, "delay 2"=w8) -> (instance out=w9)
  $"Measured channel impairements" <- w9
