vi "strip_control_MIMO.gvi"   [LabVIEW NXG]
inputs:
  "Modulation Parameters In": T6 = {"Modulation Type"="QPSK", "Control Information\nfor Packet Header/Tail"={"Training Sequence 1 (derived)"=[], "Zero Pad Length"=0, "Training Sequence 2 (derived)"=[]}, "RX Oversample Factor"=20, "Synchronization Options"={"Synchronization Method"="Timing Estimation", "Fixed Offset"=0, "Symbol Timing Recovery Method"="Max Energy", "Frame Detection Method"="Sliding Correlator", "Correct Frequency Offset"=FALSE}, "Number of Data Symbols (Derived)"=250, "RX Sample Rate"=4000000, "Pulse Shaping Parameters"={"Modulation Type"="PSK", "Pulse Shaping Filter"="Raised Cosine", "Filter Parameter"=0.5, "Filter Length (Symbols)"=8}, "Channel Estimation/Equalization Parameters"={"Equalization Method"="Direct", "Channel Estimate Length"=4, "Equalizer Length"=4, "Equalizer Delay"=-1}}
  "input 1": c128[]
  "input 2": c128[]
  "error in (no error)": error
  "OFDM Parameters In": T7 = {"FFT size (N)"=64, "Length of CP (Lc)"=8, "Null Tones"=[], "Number of OFDM Symbols (derived)"=1, "Training Sequence FFT size"=0, "Training Sequence Length of CP"=0, "Number of null tones"=0}
outputs:
  "Modulation Parameters Out": T6
  "data symbols 1": c128[]
  "data symbols 2": c128[]
  "error out": error
  "OFDM Parameters Out": T7
types:
  T1 = cluster{"Training Sequence 1 (derived)": c128[], "Zero Pad Length": i32, "Training Sequence 2 (derived)": c128[]}
  T2 = cluster{"Synchronization Method": string, "Fixed Offset": i32, "Symbol Timing Recovery Method": string, "Frame Detection Method": string, "Correct Frequency Offset": bool}
  T3 = enum{"none", "Raised Cosine", "Root Raised Cos", "Gaussian"}
  T4 = cluster{"Modulation Type": enum{"FSK", "PSK", "QAM", "MSK", "PAM", "ASK"}, "Pulse Shaping Filter": T3, "Filter Parameter": f64, "Filter Length (Symbols)": i32}
  T5 = cluster{"Equalization Method": string, "Channel Estimate Length": i32, "Equalizer Length": i32, "Equalizer Delay": i32}
  T6 = cluster{"Modulation Type": string, "Control Information\nfor Packet Header/Tail": T1, "RX Oversample Factor": i32, "Synchronization Options": T2, "Number of Data Symbols (Derived)": i32, "RX Sample Rate": f64, "Pulse Shaping Parameters": T4, "Channel Estimation/Equalization Parameters": T5}
  T7 = cluster{"FFT size (N)": i32, "Length of CP (Lc)": i32, "Null Tones": u32[], "Number of OFDM Symbols (derived)": i32, "Training Sequence FFT size": i32, "Training Sequence Length of CP": i32, "Number of null tones": i32}
diagram:
  $"Modulation Parameters Out" <- $"Modulation Parameters In"
  case ($"error in (no error)") {
    frame No Error {
      Property Node(instance in=$"Modulation Parameters In") -> ("Control Information\nfor Packet Header/Tail:Training Sequence 1 (derived)"=w3, "Number of Data Symbols (Derived)"=w4)
      Array Size(array=w3) -> (size(s)=w5)
      Property Node(instance in=$"OFDM Parameters In") -> ("FFT size (N)"=w6, "Number of null tones"=w7, "Length of CP (Lc)"=w8)
      Subtract(x=w6, y=w7) -> w9
      Quotient And Remainder(x=w4, y=w9) -> (floor(x/y)=w10)
      Increment(x=w10) -> w11
      Quotient And Remainder(x=w11, y=2) -> (x-y*floor(x/y)=w12)
      Is Not Equal To 0(x=w12) -> w13
      Select(s=w13, t=1, f=0) -> w14
      Add(w14, w11) -> w15
      Add(w6, w8) -> w16
      Multiply(w15, w16) -> w17
      # Remove training sequence and zero pad to recover data
      Array Subset(array=$"input 1", index0=w5, length0=w17) -> w18
      $"data symbols 1" <- w18
      Array Subset(array=$"input 2", index0=w5, length0=w17) -> w19
      $"data symbols 2" <- w19
      w1 = $"error in (no error)"
      w2 = $"OFDM Parameters In"
    }
    frame Error {
      w1 = $"error in (no error)"
      w2 = default
    }
  }
  $"OFDM Parameters Out" <- w2
  $"error out" <- w1
