vi "receiver_MIMO.gvi"   [LabVIEW NXG]
inputs:
  "HW Parameters In": T1 = {"Active Antenna"="RX1", "Carrier Frequency (Hz)"=915000000, "Gain (dB)"=10, "Trigger Level"=0.01, "Bandwidth (Hz)"=40000000, "Reference Position (%)"=10, "Capture Time (s)"=0.002, "Simulate"=FALSE, "Device IP Address"="192.168.10.2"}
  "Modulation Parameters In": T7 = {"Modulation Type"="QPSK", "Control Information\nfor Packet Header/Tail"={"Training Sequence 1 (derived)"=[], "Zero Pad Length"=0, "Training Sequence 2 (derived)"=[]}, "RX Oversample Factor"=20, "Synchronization Options"={"Synchronization Method"="Timing Estimation", "Fixed Offset"=0, "Symbol Timing Recovery Method"="Max Energy", "Frame Detection Method"="Sliding Correlator", "Correct Frequency Offset"=FALSE}, "Number of Data Symbols (Derived)"=100, "RX Sample Rate"=4000000, "Pulse Shaping Parameters"={"Modulation Type"="PSK", "Pulse Shaping Filter"="Root Raised Cos", "Filter Parameter"=0.5, "Filter Length (Symbols)"=8}, "Channel Estimation/Equalization Parameters"={"Equalization Method"="Direct", "Channel Estimate Length"=1, "Equalizer Length"=1, "Equalizer Delay"=-1}}
  "queue in": cluster{"Key Bit Sequence": Queue<u8[]>}
  "error in (no error)": error
  "Input Complex Waveform 1": cluster{"t0": f64, "dt": f64, "Y": c128[]}
  "OFDM Parameters In": T15 = {"FFT size (N)"=64, "Length of CP (Lc)"=8, "Null Tones"=[], "Number of OFDM Symbols (derived)"=1, "Training Sequence FFT size"=0, "Training Sequence Length of CP"=0, "Number of null tones"=0}
  "Input Complex Waveform 2": cluster{"t0": f64, "dt": f64, "Y": c128[]}
  "Channel Model Parameters_2": T13 = {"Noise Power (dB)"=-Inf, "Channel Model"="AWGN"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}
outputs:
  "error out": error
  "Modulation Parameters Out": T7
  "HW Parameters Out": T1
  "queue out": cluster{"Key Bit Sequence": Queue<u8[]>}
  "Measured channel impairements": T10
  "Overhead Offset": i32
  "Symbol Rate": f64
  "Bit-Error Rate": f64
  "Offset 1": i32
  "RX Waveforms Out 2": T8
  "RX Waveforms Out 1": T8
  "Received Constellation": T12[]
  "Power delay profiles": T11
  "Offset 2": i32
  "Key Bit Sequence": i8[]
panel controls:
  "Channel Model Parameters": T13 = {"Noise Power (dB)"=-Inf, "Channel Model"="AWGN"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}
  "Training Sequences In": T14 = {"Length 11 Zadoff Chu 1 "=[1+0i, 1+0i, 1+0i, -1+0i, 1+0i, 1+0i, -1+0i, 1+0i, -1+0i, -1+0i, -1+0i], "Length 11 Zadoff Chu 2"=[1+0i, -1+0i, 1+0i, 1+0i, -1+0i, 1+0i, -1+0i, -1+0i, -1+0i, 1+0i, 1+0i]}
types:
  T1 = cluster{"Active Antenna": string, "Carrier Frequency (Hz)": f64, "Gain (dB)": f64, "Trigger Level": f64, "Bandwidth (Hz)": f64, "Reference Position (%)": f64, "Capture Time (s)": f64, "Simulate": bool, "Device IP Address": string}
  T2 = cluster{"Training Sequence 1 (derived)": c128[], "Zero Pad Length": i32, "Training Sequence 2 (derived)": c128[]}
  T3 = cluster{"Synchronization Method": string, "Fixed Offset": i32, "Symbol Timing Recovery Method": string, "Frame Detection Method": string, "Correct Frequency Offset": bool}
  T4 = enum{"none", "Raised Cosine", "Root Raised Cos", "Gaussian"}
  T5 = cluster{"Modulation Type": enum{"FSK", "PSK", "QAM", "MSK", "PAM", "ASK"}, "Pulse Shaping Filter": T4, "Filter Parameter": f64, "Filter Length (Symbols)": i32}
  T6 = cluster{"Equalization Method": string, "Channel Estimate Length": i32, "Equalizer Length": i32, "Equalizer Delay": i32}
  T7 = cluster{"Modulation Type": string, "Control Information\nfor Packet Header/Tail": T2, "RX Oversample Factor": i32, "Synchronization Options": T3, "Number of Data Symbols (Derived)": i32, "RX Sample Rate": f64, "Pulse Shaping Parameters": T5, "Channel Estimation/Equalization Parameters": T6}
  T8 = cluster{"Eye Diagram": cluster{"t0": f64, "dt": f64, "Y": f64[]}[], "Power Delay Profile 1": DoubleAnalogWaveform, "IQ Graph": cluster{"Element 1": f64[], "Element 2": f64[]}[], "Power Delay Profile 2": DoubleAnalogWaveform}
  T9 = cluster{"Element 1": c128[], "Element 2": c128[], "Element 3": c128[], "Element 4": c128[]}
  T10 = cluster{"SNR(dB)": f64, "freq. offset 1": f64, "delay 1": f64, "Channel estimates": T9, "freq. offset 2": f64, "delay 2": f64}
  T11 = cluster{"Element 1": DoubleAnalogWaveform, "Element 2": DoubleAnalogWaveform, "Element 3": DoubleAnalogWaveform, "Element 4": DoubleAnalogWaveform}
  T12 = cluster{"constellation": f64[], "oversampled data": f64[]}
  T13 = cluster{"Noise Power (dB)": f64, "Channel Response h_11": c128[], "Frequency Offset": f64, "Delay (sec)": f64, "Channel Model": string, "Channel Response h_12": c128[], "Channel Response h_21": c128[], "Channel Response h_22": c128[]}
  T14 = cluster{"Length 11 Zadoff Chu 1 ": c128[], "Length 11 Zadoff Chu 2": c128[]}
  T15 = cluster{"FFT size (N)": i32, "Length of CP (Lc)": i32, "Null Tones": u32[], "Number of OFDM Symbols (derived)": i32, "Training Sequence FFT size": i32, "Training Sequence Length of CP": i32, "Number of null tones": i32}
diagram:
  $"HW Parameters Out" <- $"HW Parameters In"
  case ($"error in (no error)") {
    frame No Error {
      call "Training_sequence_preprocessing.gviprotected"(Training Sequences in=$"Training Sequences In", error in (no error)=$"error in (no error)") -> (Training Sequences out=w4, error out=w5)
      call "receiver_init (SubVI).gvi"(Modulation Parameters In=$"Modulation Parameters In", queue in=$"queue in", error in=w5, Training Sequences=w4) -> (Modulation Parameters Out=w6, queue out=w3, symbol rate=w7, key bit sequence=w8, overhead offset=w9, error out=w10)
      call "matched_filtering_MIMO.gviprotected"(Modulation Parameters In=w6, Input Complex Waveform 1=$"Input Complex Waveform 1", Input Complex Waveform 2=$"Input Complex Waveform 2", error in (no error)=w10) -> (Modulation Parameters Out=w11, Output Complex Waveform 1=w12, Output Complex Waveform 2=w13, error out=w14)
      call "synchronize_MIMO.gvi"(Modulation Parameters In=w11, Input Complex Waveform 1=w12, Input Complex Waveform 2=w13, error in (no error)=w14) -> (Modulation Parameters Out=w15, Output Complex Symbols 1=w16, Intermediate Complex Waveform 2=w17, Offset 1=w18, error out=w19, Intermediate Complex Waveform 1=w20, Estimated Frequency Offset 1=w21, Output Complex Symbols 2=w22, Offset 2=w23, Estimated Frequency Offset 2=w24)
      call "channel_estimate_MIMO.gviprotected"(Modulation Parameters In=w15, Input Symbol Sequence 1=w16, Input Symbol Sequence 2=w22, error in (no error)=w19) -> (Modulation Parameters Out=w25, Mean-Square Error=w26, error out=w27)
      Property Node(instance in=$"Channel Model Parameters_2") -> ("Channel Response h_11"=w28, "Channel Response h_12"=w29, "Channel Response h_21"=w30, "Channel Response h_22"=w31)
      Build Cluster(w28, w29, w30, w31) -> w32
      call "receiver_channel_impairments_MIMO (SubVI).gvi"(Modulation Parameters In=w25, mean-squared error=w26, Channel estimates=w32, offset 1=w18, estimated frequency offset 1=w21, offset 2=w23, overhead offset=w9, estimated frequency offset 2=w24) -> (Measured channel impairements=w33)
      call "strip_control_MIMO.gvi"(Modulation Parameters In=w25, input 1=w16, input 2=w22, error in (no error)=w27, OFDM Parameters In=$"OFDM Parameters In") -> (Modulation Parameters Out=w34, data symbols 1=w35, data symbols 2=w36, error out=w37, OFDM Parameters Out=w38)
      call "OFDM_demodulator_MIMO.gviprotected"(Modulation Parameters In=w34, Received Samples 1=w35, Received Samples 2=w36, OFDM Parameters in=w38, error in (no error)=w37) -> (Modulation Parameters Out=w39, Demodulated Symbols=w40, Demodulated Symbols_2=w41, error out=w42)
      call "Alamouti_RX_student_OFDM.gvi"(Modulation Parameters In=w39, Input Complex Symbols 1=w40, Input Complex Symbols 2=w41, Channel estimates=w32, error in (no error)=w42, OFDM Parameters In=w38) -> (Output Complex Symbols=w43, Modulation Parameters Out=w44, error out=w45)
      call "decode.gviprotected"(Modulation Parameters In=w44, input symbols=w43, error in (no error)=w45) -> (Modulation Parameters Out=w46, decoded bit stream=w47, error out=w48)
      # 3. Plot the symbol constellation and eye diagram for recovered symbols
      # recovered symbols
      call "receiver_generate_waveforms (SubVI).gvi"(Modulation Parameters In=w46, Intermediate Complex Waveform 1=w20, Data Symbols=w43, Measured channel impairements=w33, Intermediate Complex Waveform 2=w17) -> (Modulation Parameters Out=w2, RX Waveforms Out 1=w49, Power delay profiles=w50, RX Waveforms Out 2=w51, Received Constellation=w52)
      $"RX Waveforms Out 1" <- w49
      $"Symbol Rate" <- w7
      $"RX Waveforms Out 2" <- w51
      $"Received Constellation" <- w52
      $"Power delay profiles" <- w50
      # key bit sequence
      $"Offset 1" <- w18
      call "error_detect.gvi"(input bit sequence=w47, key bit sequence=w8, error in (no error)=w48) -> (bit-error rate=w53, error out=w1)
      $"Bit-Error Rate" <- w53
      $"Offset 2" <- w23
      $"Key Bit Sequence" <- w8
      $"Overhead Offset" <- w9
      $"Measured channel impairements" <- w33
    }
    frame Error {
      w1 = $"error in (no error)"
      w2 = $"Modulation Parameters In"
      w3 = $"queue in"
    }
  }
  $"Modulation Parameters Out" <- w2
  $"error out" <- w1
  $"queue out" <- w3
