vi "simulator.gvi"   [LabVIEW NXG]
panel controls:
  "# of Iterations": i32 = 1
  "Control Information for Packet Header/Tail": T1 = {"Training Sequences"="Zadoff Chu", "Zero Pad Length"=8}
  "Pulse Shaping Parameters": T3 = {"Modulation Type"="PSK", "Pulse Shaping Filter"="Raised Cosine", "Filter Parameter"=0.5, "Filter Length (Symbols)"=8}
  "Packet Length (Bits)": i32 = 500
  "RX Oversample Factor": i32 = 20
  "RX Sample Rate": f64 = 4000000
  "TX Sample Rate": f64 = 4000000
  "TX Oversample Factor": i32 = 20
  "RX HW Parameters": T4 = {"Active Antenna"="RX1", "Carrier Frequency (Hz)"=915000000, "Gain (dB)"=10, "Trigger Level"=0.01, "Bandwidth (Hz)"=915000000, "Reference Position (%)"=10, "Capture Time (s)"=0.0033, "Simulate"=FALSE, "Device IP Address"="192.168.11.2"}
  "Channel Model Parameters": T5 = {"Noise Power (dB)"=-Inf, "Channel Model"="AWGN"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}
  "TX HW Parameters": T6 = {"Active Antenna"="TX1", "Carrier Frequency (Hz)"=915000000, "Gain (dB)"=10, "Generation Mode"="Simulate", "Device IP Address"="192.168.11.3"}
  "Modulation Type": string = "QPSK"
  "Channel Estimation/Equalization Parameters": T7 = {"Equalization Method"="Direct", "Channel Estimate Length"=4, "Equalizer Length"=4, "Equalizer Delay"=-1}
  "Synchronization Options": T8 = {"Synchronization Method"="Timing Estimation", "Fixed Offset"=0, "Symbol Timing Recovery Method"="Max Energy", "Frame Detection Method"="Sliding Correlator", "Correct Frequency Offset"=FALSE}
  "Plots": i32
  "RX modulation parameters": T11 = {"Modulation Type"="QPSK", "Control Information\nfor Packet Header/Tail"={"Training Sequence 1 (derived)"=[], "Zero Pad Length"=0, "Training Sequence 2 (derived)"=[]}, "RX Oversample Factor"=20, "Synchronization Options"={"Synchronization Method"="Timing Estimation", "Fixed Offset"=0, "Symbol Timing Recovery Method"="Max Energy", "Frame Detection Method"="Sliding Correlator", "Correct Frequency Offset"=FALSE}, "Number of Data Symbols (Derived)"=250, "RX Sample Rate"=4000000, "Pulse Shaping Parameters"={"Modulation Type"="PSK", "Pulse Shaping Filter"="Raised Cosine", "Filter Parameter"=0.5, "Filter Length (Symbols)"=8}, "Channel Estimation/Equalization Parameters"={"Equalization Method"="Direct", "Channel Estimate Length"=4, "Equalizer Length"=4, "Equalizer Delay"=-1}}
  "TX modulation Parameters": T13 = {"Modulation Type"="QPSK", "Pulse Shaping Parameters"={"Modulation Type"="PSK", "Pulse Shaping Filter"="Raised Cosine", "Filter Parameter"=0.5, "Filter Length (Symbols)"=8}, "TX Oversample Factor"=20, "Packet Length (Bits)"=500, "TX Sample Rate"=4000000, "Control Information For Packet Header/Tail"={"Training Sequences "="Length 11 Barker Sequence", "Zero Pad Length"=8}}
  "OFDM Parameters In": T16 = {"FFT size (N)"=64, "Length of CP (Lc)"=8, "Null Tones"=[], "Number of OFDM Symbols (derived)"=1, "Training Sequence FFT size"=0, "Training Sequence Length of CP"=0, "Number of null tones"=0}
panel indicators:
  "Average Bit-Error Rate": f64
  "Error Statistic (averaged over the two antennas)": f64
  "Estimated time Offset 1": i32
  "error out": error
  "Received Constellation": T9[]
  "Received Eye Diagram 2": cluster{"t0": f64, "dt": f64, "Y": f64[]}[]
  "Power Delay Profile h_11": waveform<f64>
  "Q Data RX 1": waveform<f64>
  "I Data RX 1": waveform<f64>
  "Received Eye Diagram 1": cluster{"t0": f64, "dt": f64, "Y": f64[]}[]
  "Power Delay Profile h_12": waveform<f64>
  "Power Delay Profile h_21": waveform<f64>
  "Power Delay Profile h_22": waveform<f64>
  "Estimated time Offset 2": i32
  "Measured channel impairements": T15
  "I Data RX 2": waveform<f64>
  "Q Data RX 2": waveform<f64>
types:
  T1 = cluster{"Training Sequences": string, "Zero Pad Length": i32}
  T2 = enum{"none", "Raised Cosine", "Root Raised Cos", "Gaussian"}
  T3 = cluster{"Modulation Type": enum{"FSK", "PSK", "QAM", "MSK", "PAM", "ASK"}, "Pulse Shaping Filter": T2, "Filter Parameter": f64, "Filter Length (Symbols)": i32}
  T4 = cluster{"Active Antenna": string, "Carrier Frequency (Hz)": f64, "Gain (dB)": f64, "Trigger Level": f64, "Bandwidth (Hz)": f64, "Reference Position (%)": f64, "Capture Time (s)": f64, "Simulate": bool, "Device IP Address": string}
  T5 = cluster{"Noise Power (dB)": f64, "Channel Response h_11": c128[], "Frequency Offset": f64, "Delay (sec)": f64, "Channel Model": string, "Channel Response h_12": c128[], "Channel Response h_21": c128[], "Channel Response h_22": c128[]}
  T6 = cluster{"Active Antenna": string, "Carrier Frequency (Hz)": f64, "Gain (dB)": f64, "Generation Mode": enum{"Single Shot", "Simulate", "Continuous"}, "Device IP Address": string}
  T7 = cluster{"Equalization Method": string, "Channel Estimate Length": i32, "Equalizer Length": i32, "Equalizer Delay": i32}
  T8 = cluster{"Synchronization Method": string, "Fixed Offset": i32, "Symbol Timing Recovery Method": string, "Frame Detection Method": string, "Correct Frequency Offset": bool}
  T9 = cluster{"constellation": f64[], "oversampled data": f64[]}
  T10 = cluster{"Training Sequence 1 (derived)": c128[], "Zero Pad Length": i32, "Training Sequence 2 (derived)": c128[]}
  T11 = cluster{"Modulation Type": string, "Control Information\nfor Packet Header/Tail": T10, "RX Oversample Factor": i32, "Synchronization Options": T8, "Number of Data Symbols (Derived)": i32, "RX Sample Rate": f64, "Pulse Shaping Parameters": T3, "Channel Estimation/Equalization Parameters": T7}
  T12 = cluster{"Training Sequences ": string, "Zero Pad Length": i32}
  T13 = cluster{"Modulation Type": string, "Pulse Shaping Parameters": T3, "TX Oversample Factor": i32, "Packet Length (Bits)": i32, "TX Sample Rate": f64, "Control Information For Packet Header/Tail": T12}
  T14 = cluster{"Estimate h_11": c128[], "Estimate h_12": c128[], "Estimate h21": c128[], "Estimate h_22": c128[]}
  T15 = cluster{"SNR(dB)": f64, "freq. offset 1": f64, "delay 1": f64, "Channel estimates": T14, "freq. offset 2": f64, "delay 2": f64}
  T16 = cluster{"FFT size (N)": i32, "Length of CP (Lc)": i32, "Null Tones": u32[], "Number of OFDM Symbols (derived)": i32, "Training Sequence FFT size": i32, "Training Sequence Length of CP": i32, "Number of null tones": i32}
diagram:
  w1 = $"OFDM Parameters In"
  w2 = $"# of Iterations"
  # actual delay
  Property Node(instance in=$"Channel Model Parameters") -> (instance out=w3, "Delay (sec)"=w4)
  Property Node(instance in=$"RX HW Parameters", "Simulate"=TRUE) -> (instance out=w5)
  Property Node(instance in=$"Control Information for Packet Header/Tail") -> ("Zero Pad Length"=w6)
  Property Node(instance in=T10 {all zero or empty}, "Zero Pad Length"=w6) -> (instance out=w7)
  # Ts
  Property Node(instance in=$"RX modulation parameters", "Modulation Type"=$"Modulation Type", "Pulse Shaping Parameters"=$"Pulse Shaping Parameters", "Control Information\nfor Packet Header/Tail"=w7, "RX Oversample Factor"=$"RX Oversample Factor", "Channel Estimation/Equalization Parameters"=$"Channel Estimation/Equalization Parameters", "Synchronization Options"=$"Synchronization Options", "RX Sample Rate"=$"RX Sample Rate") -> (instance out=w8)
  Property Node(instance in=$"TX HW Parameters", "Generation Mode"="Simulate") -> (instance out=w9)
  Property Node(instance in=$"TX modulation Parameters", "Modulation Type"=$"Modulation Type", "Pulse Shaping Parameters"=$"Pulse Shaping Parameters", "TX Oversample Factor"=$"TX Oversample Factor", "Packet Length (Bits)"=$"Packet Length (Bits)", "Control Information For Packet Header/Tail"=$"Control Information for Packet Header/Tail", "TX Sample Rate"=$"TX Sample Rate") -> (instance out=w10)
  Divide(x=$"RX Oversample Factor", y=$"RX Sample Rate") -> w11
  for (N = w2) {
    call "top_tx_MIMO.gvi"(HW Parameters=w9, Modulation Parameters=w10, OFDM Parameters In=w1) -> (error out=w15, Output IQ Waveform 1=w16, Output IQ Waveform 2=w17)
    # IQ Waveforms
    call "top_rx_MIMO.gvi"(error in=w15, IQ Waveform 1=w16, HW Parameters=w5, RX Modulation Parameters=w8, IQ Waveform 2=w17, Channel Model Parameters=w3, OFDM Parameters In=w1, TX Modulation Parameters=w10) -> (Eye Diagram 1=w18, Average Bit-Error Rate=w19, I Data RX 1=w20, Q Data RX 1=w21, Measured channel impairements=w22, I Data RX 2=w23, Eye Diagram 2=w24, error out=w25, Estimated Time Offset 1=w26, Power Delay Profile h_11=w27, Q Data RX 2=w28, Power Delay Profile h_12=w29, Power Delay Profile h_21=w30, Power Delay Profile h_22=w31, Estimated Time Offset 2=w32, Signal Constellation=w33)
    Property Node(instance in=w22) -> ("delay 1"=w34, "delay 2"=w35)
    Subtract(x=w4, y=w34) -> w36
    Divide(x=w36, y=w11) -> w37
    Square(x=w37) -> w38
    Subtract(x=w4, y=w35) -> w39
    Divide(x=w39, y=w11) -> w40
    Square(x=w40) -> w41
    $"Measured channel impairements" <- w22
    $"Received Constellation" <- w33
    $"I Data RX 1" <- w20
    $"Q Data RX 1" <- w21
    $"I Data RX 2" <- w23
    $"Q Data RX 2" <- w28
    $"Received Eye Diagram 1" <- w18
    $"Received Eye Diagram 2" <- w24
    $"error out" <- w25
    $"Estimated time Offset 1" <- w26
    $"Estimated time Offset 2" <- w32
    $"Power Delay Profile h_11" <- w27
    $"Power Delay Profile h_12" <- w29
    $"Power Delay Profile h_21" <- w30
    $"Power Delay Profile h_22" <- w31
    append w19 to w12
    append w38 to w13
    append w41 to w14
  }
  call "Mean (DBL).gvi"(X=w13) -> (mean=w42)
  call "Mean (DBL).gvi"(X=w14) -> (mean=w43)
  Add(w42, w43) -> w44
  Divide(x=w44, y=2) -> w45
  $"Error Statistic (averaged over the two antennas)" <- w45
  call "Mean (DBL).gvi"(X=w12) -> (mean=w46)
  $"Average Bit-Error Rate" <- w46
