vi "transmitter_MIMO.gvi"   [LabVIEW NXG]
inputs:
  "HW Parameters In": T2 = {"Active Antenna"="TX1", "Carrier Frequency (Hz)"=915000000, "Gain (dB)"=10, "Generation Mode"="Continuous", "Device IP Address"="192.168.10.3"}
  "Modulation Parameters In": T6 = {"Modulation Type"="QPSK", "Pulse Shaping Parameters"={"Modulation Type"="PSK", "Pulse Shaping Filter"="Raised Cosine", "Filter Parameter"=0.5, "Filter Length (Symbols)"=8}, "TX Oversample Factor"=20, "Packet Length (Bits)"=500, "TX Sample Rate"=100, "Control Information For Packet Header/Tail"={"Training Sequences "="Zadoff Chu", "Zero Pad Length"=8}}
  "OFDM Parameters In": T8 = {"FFT size (N)"=64, "Length of CP (Lc)"=8, "Null Tones"=[0, 30, 31, 32], "Number of OFDM Symbols (derived)"=1, "Training Sequence FFT size"=0, "Training Sequence Length of CP"=0, "Number of null tones"=0}
  "error in": error
  "queue in": cluster{"Key Bit Sequence": Queue<u8[]>}
outputs:
  "error out": error
  "HW Parameters Out": T2
  "Modulation Parameters Out": T6
  "Output conplex waveform 1": cluster{"t0": f64, "dt": f64, "Y": c128[]}
  "Number of Data Symbols": i32
  "Key Bit Sequence": i8[]
  "queue out": cluster{"Key Bit Sequence": Queue<u8[]>}
  "Eye Diagram 1": cluster{"t0": f64, "dt": f64, "Y": f64[]}[]
  "Transmitted Constellation 1": T1[]
  "Output complex waveform 2": cluster{"t0": f64, "dt": f64, "Y": c128[]}
  "Eye Diagram 2": cluster{"t0": f64, "dt": f64, "Y": f64[]}[]
  "Transmitted Constellation 2": T1[]
panel controls:
  "Tab": i32
  "Tab_2": i32
  "Training Sequences In": T7 = {"Length 11 Zadoff Chu 1 "=[1+0i, 1+0i, 1+0i, -1+0i, 1+0i, 1+0i, -1+0i, 1+0i, -1+0i, -1+0i, -1+0i], "Length 11 Zadoff Chu 2"=[1+0i, -1+0i, 1+0i, 1+0i, -1+0i, 1+0i, -1+0i, -1+0i, -1+0i, 1+0i, 1+0i]}
types:
  T1 = cluster{"constellation": f64[], "oversampled data": f64[]}
  T2 = cluster{"Active Antenna": string, "Carrier Frequency (Hz)": f64, "Gain (dB)": f64, "Generation Mode": enum{"Single Shot", "Simulate", "Continuous"}, "Device IP Address": string}
  T3 = enum{"none", "Raised Cosine", "Root Raised Cos", "Gaussian"}
  T4 = cluster{"Modulation Type": enum{"FSK", "PSK", "QAM", "MSK", "PAM", "ASK"}, "Pulse Shaping Filter": T3, "Filter Parameter": f64, "Filter Length (Symbols)": i32}
  T5 = cluster{"Training Sequences ": string, "Zero Pad Length": i32}
  T6 = cluster{"Modulation Type": string, "Pulse Shaping Parameters": T4, "TX Oversample Factor": i32, "Packet Length (Bits)": i32, "TX Sample Rate": f64, "Control Information For Packet Header/Tail": T5}
  T7 = cluster{"Length 11 Zadoff Chu 1 ": c128[], "Length 11 Zadoff Chu 2": c128[]}
  T8 = cluster{"FFT size (N)": i32, "Length of CP (Lc)": i32, "Null Tones": u32[], "Number of OFDM Symbols (derived)": i32, "Training Sequence FFT size": i32, "Training Sequence Length of CP": i32, "Number of null tones": i32}
diagram:
  case ($"error in") {
    frame No Error {
      call "transmitter_init (SubVI).gvi"(Modulation Parameters In=$"Modulation Parameters In") -> (symbol rate=w3, number of data symbols=w4)
      call "source.gviprotected"(Modulation Parameters In=$"Modulation Parameters In", error in (no error)=$"error in") -> (Modulation Parameters Out=w5, output bit stream=w6, error out=w7)
      call "modulate.gviprotected"(Modulation Parameters In=w5, input bit stream=w6, error in (no error)=w7) -> (Modulation Parameters Out=w8, output symbols=w9, error out=w10)
      call "Alamouti_TX_student_OFDM.gvi"(input symbols=w9, OFDM Parameters In=$"OFDM Parameters In", Modulation Parameters In=w8, error in (no error)=w10) -> (Modulation Parameters Out=w11, output 1=w12, output 2=w13, error out=w14)
      call "OFDM_modulator_MIMO.gviprotected"(Input Symbols 2=w13, Input Symbols 1=w12, OFDM Parameters In=$"OFDM Parameters In", error in (no error)=w14) -> (Output Symbols 2=w15, Output Symbols 1=w16, error out=w17)
      call "Training_sequence_preprocessing.gviprotected"(Training Sequences in=$"Training Sequences In", error in (no error)=w17) -> (Training Sequences out=w18, error out=w19)
      call "add_control_MIMO.gviprotected"(error in (no error)=w19, input 1=w16, Modulation Parameters In=w11, Training Sequences=w18, input 2=w15) -> (error out=w20, output 1=w21, Modulation Parameters Out=w22, output 2=w23)
      call "transmitter_enque (SubVI).gvi"(queue in=$"queue in", error in=w20, key bit stream 1=w6) -> (error out=w24, queue out=w25)
      call "pulse_shaping.gviprotected"(Modulation Parameters In=w22, input 1=w21, input 2=w23, error in (no error)=w24) -> (Modulation Parameters Out=w2, output 1=w26, output 2=w27, error out=w1)
      Property Node(instance in=w2) -> ("TX Sample Rate"=w28)
      Reciprocal(x=w28) -> w29
      call "make_MTwaveform.gvi"(dt=w29, Y=w26) -> (output MT waveform=w30)
      call "transmitter_generate_waveforms (SubVI).gvi"(complex waveform=w30, symbol rate (Hz)=w3, Y=w16) -> (transmitted constellation=w31, eye diagram=w32)
      $"Transmitted Constellation 1" <- w31
      # generate plots
      $"Eye Diagram 1" <- w32
      call "make_MTwaveform.gvi"(dt=w29, Y=w27) -> (output MT waveform=w33)
      call "transmitter_generate_waveforms (SubVI).gvi"(complex waveform=w33, symbol rate (Hz)=w3, Y=w15) -> (transmitted constellation=w34, eye diagram=w35)
      $"Transmitted Constellation 2" <- w34
      $"Eye Diagram 2" <- w35
      $"Number of Data Symbols" <- w4
      $"Key Bit Sequence" <- w6
      $"Output conplex waveform 1" <- w30
      $"Output complex waveform 2" <- w33
      $"queue out" <- w25
    }
    frame Error {
      w1 = $"error in"
      w2 = $"Modulation Parameters In"
    }
  }
  $"Modulation Parameters Out" <- w2
  $"error out" <- w1
  $"HW Parameters Out" <- $"HW Parameters In"
