vi "Alamouti_RX_student_OFDM.gvi"   [LabVIEW NXG]
inputs:
  "Modulation Parameters In": T6 = {"Modulation Type"="QPSK", "Control Information\nfor Packet Header/Tail"={"Training Sequence 1 (derived)"=[], "Zero Pad Length"=0, "Training Sequence 2 (derived)"=[]}, "RX Oversample Factor"=20, "Synchronization Options"={"Synchronization Method"="Timing Estimation", "Fixed Offset"=0, "Symbol Timing Recovery Method"="Max Energy", "Frame Detection Method"="Sliding Correlator", "Correct Frequency Offset"=FALSE}, "Number of Data Symbols (Derived)"=250, "RX Sample Rate"=4000000, "Pulse Shaping Parameters"={"Modulation Type"="PSK", "Pulse Shaping Filter"="Raised Cosine", "Filter Parameter"=0.5, "Filter Length (Symbols)"=8}, "Channel Estimation/Equalization Parameters"={"Equalization Method"="Direct", "Channel Estimate Length"=4, "Equalizer Length"=4, "Equalizer Delay"=-1}}
  "Input Complex Symbols 1": c128[]
  "Input Complex Symbols 2": c128[]
  "Channel estimates": T7
  "error in (no error)": error
  "OFDM Parameters In": T8 = {"FFT size (N)"=64, "Length of CP (Lc)"=8, "Null Tones"=[], "Number of OFDM Symbols (derived)"=1, "Training Sequence FFT size"=0, "Training Sequence Length of CP"=0, "Number of null tones"=0}
outputs:
  "Output Complex Symbols": c128[]
  "Modulation Parameters Out": T6
  "error out": error
types:
  T1 = cluster{"Training Sequence 1 (derived)": c128[], "Zero Pad Length": i32, "Training Sequence 2 (derived)": c128[]}
  T2 = cluster{"Synchronization Method": string, "Fixed Offset": i32, "Symbol Timing Recovery Method": string, "Frame Detection Method": string, "Correct Frequency Offset": bool}
  T3 = enum{"none", "Raised Cosine", "Root Raised Cos", "Gaussian"}
  T4 = cluster{"Modulation Type": enum{"FSK", "PSK", "QAM", "MSK", "PAM", "ASK"}, "Pulse Shaping Filter": T3, "Filter Parameter": f64, "Filter Length (Symbols)": i32}
  T5 = cluster{"Equalization Method": string, "Channel Estimate Length": i32, "Equalizer Length": i32, "Equalizer Delay": i32}
  T6 = cluster{"Modulation Type": string, "Control Information\nfor Packet Header/Tail": T1, "RX Oversample Factor": i32, "Synchronization Options": T2, "Number of Data Symbols (Derived)": i32, "RX Sample Rate": f64, "Pulse Shaping Parameters": T4, "Channel Estimation/Equalization Parameters": T5}
  T7 = cluster{"Element 1": c128[], "Element 2": c128[], "Element 3": c128[], "Element 4": c128[]}
  T8 = cluster{"FFT size (N)": i32, "Length of CP (Lc)": i32, "Null Tones": u32[], "Number of OFDM Symbols (derived)": i32, "Training Sequence FFT size": i32, "Training Sequence Length of CP": i32, "Number of null tones": i32}
diagram:
  Property Node(instance in=$"OFDM Parameters In") -> ("FFT size (N)"=w1)
  Array Size(array=$"Input Complex Symbols 1") -> (size(s)=w2)
  Divide(x=w2, y=w1) -> w3
  Property Node(instance in=$"Channel estimates") -> ("Element 1"=w4, "Element 2"=w5, "Element 3"=w6, "Element 4"=w7)
  call "Complex FFT.gvi"(x=w4, shift?=FALSE, FFT size=w1) -> (FFT {x}=w8)
  Decimate Array(array=w8) -> (out0=w9)
  call "Repeat.gvi"(Array=w9, Numeric=w3) -> (output array=w10)
  Absolute Value(x=w10) -> w11
  # a0[0],a0[2],...
  Square(x=w11) -> w12
  call "Complex FFT.gvi"(x=w5, shift?=FALSE, FFT size=w1) -> (FFT {x}=w13)
  Decimate Array(array=w13) -> (out0=w14)
  call "Repeat.gvi"(Array=w14, Numeric=w3) -> (output array=w15)
  # a1[k]
  Absolute Value(x=w15) -> w16
  Square(x=w16) -> w17
  call "Complex FFT.gvi"(x=w6, shift?=FALSE, FFT size=w1) -> (FFT {x}=w18)
  Decimate Array(array=w18) -> (out0=w19)
  call "Repeat.gvi"(Array=w19, Numeric=w3) -> (output array=w20)
  Absolute Value(x=w20) -> w21
  # a2[k]
  Square(x=w21) -> w22
  # H0[0],H0[2],...H0[63],H0[0],...
  call "Complex FFT.gvi"(x=w7, shift?=FALSE, FFT size=w1) -> (FFT {x}=w23)
  Decimate Array(array=w23) -> (out0=w24)
  call "Repeat.gvi"(Array=w24, Numeric=w3) -> (output array=w25)
  Absolute Value(x=w25) -> w26
  # a3[k]
  Square(x=w26) -> w27
  Add(w12, w17, w22, w27) -> w28
  Interleave Array(w28, w28) -> w29
  # R0,R4
  # R1,R5
  Decimate Array(array=$"Input Complex Symbols 1") -> (out0=w30, out1=w31)
  # R1[k],R5[k]
  Complex Conjugate(x + iy=w31) -> w32
  Multiply(w15, w32) -> w33
  # R2,R6
  # R3,R7
  Decimate Array(array=$"Input Complex Symbols 2") -> (out0=w34, out1=w35)
  # H1[k]*
  # H2[k]*
  Complex Conjugate(x + iy=w20) -> w36
  Multiply(w36, w34) -> w37
  # Ho[k]*
  Complex Conjugate(x + iy=w10) -> w38
  # (R0[k] R4[k])H0*[k]
  Multiply(w38, w30) -> w39
  Complex Conjugate(x + iy=w35) -> w40
  # (R3*[k] R7*[k])H3[k]
  Multiply(w25, w40) -> w41
  # ~s0,~s2,~s4
  # (R1*[k] R5*[k])H1[k]
  # (R2[k] R6[k])H2*[k]
  Add(w39, w33, w37, w41) -> w42
  Multiply(w10, w32, -1+0i) -> w43
  # H3[k]*
  # R0[k],R4[k]
  Complex Conjugate(x + iy=w25) -> w44
  Multiply(w44, w34) -> w45
  Multiply(w20, w40, -1+0i) -> w46
  Complex Conjugate(x + iy=w15) -> w47
  Multiply(w47, w30) -> w48
  # (R0[k] R4[k])H1*[k]
  # -(R1*[k] R5*[k])H0[k]
  # (R2[k] R6[k])H3*[k]
  # -(R3*[k] R7*[k])H2[k]
  Add(w48, w43, w45, w46) -> w49
  # ~s1,~s3,~s5
  Interleave Array(w42, w49) -> w50
  Divide(x=w50, y=w29) -> w51
  $"Output Complex Symbols" <- w51
  $"error out" <- $"error in (no error)"
  $"Modulation Parameters Out" <- $"Modulation Parameters In"
