vi "Repeat.gvi"   [LabVIEW NXG]
inputs:
  "Array": c128[]
  "Numeric": f64
outputs:
  "output array": c128[]
diagram:
  Array Size(array=$Array) -> (size(s)=w1)
  for (N = $Numeric) {
    Insert Into Array(inArray=$Array, index0=w1, new=$Array) -> w3
    append w3 to w2
  }
  Multiply(w1, $Numeric) -> w4
  Reshape Array(inArray=w2, size=w4) -> w5
  $"output array" <- w5
