vi "error_detect.gvi"   [LabVIEW NXG]
inputs:
  "input bit sequence": u8[]
  "key bit sequence": i8[]
  "error in (no error)": error
outputs:
  "bit-error rate": f64
  "error out": error
diagram:
  case ($"error in (no error)") {
    frame No Error {
      # compute Hamming distance
      Array Size(array=$"key bit sequence") -> (size(s)=w2)
      # Compute bit-error rate
      for (N = w2) (iteration -> i1) {
        w3 = each element of $"key bit sequence"
        Array Index(array=$"input bit sequence") -> (out0[i1]=w5)
        Is Not Equal(x=w3, y=w5) -> w6
        Boolean To Integer(Boolean=w6) -> (0, 1=w7)
        append w7 to w4
      }
      Add Array Elements(numeric array=w4) -> (sum=w8)
      To Double Precision Float(number=w8) -> w9
      Max And Min(x=w2, y=1) -> (max(x,y)=w10: i32)
      To Double Precision Float(number=w10) -> w11
      Divide(x=w9, y=w11) -> w12
      $"bit-error rate" <- w12
      w1 = $"error in (no error)"
    }
    frame Error {
      w1 = $"error in (no error)"
    }
  }
  $"error out" <- w1
