vi "make_4_channels.gvi"   [LabVIEW NXG]
inputs:
  "Channel Model Parameters": T2 = {"Noise Power (dB)"=-Inf, "Channel Model"="AWGN"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}
outputs:
  "Channel Model Parameters h_12": T1
  "Channel Model Parameters h_21": T1
  "Channel Model Parameters h_22": T1
  "Channel Model Parameters h_11": T1
panel controls:
  "Single channel template": T1 = {"Noise Power (dB)"=-Inf, "Channel Response"=[], "Frequency Offset"=0, "Delay (sec)"=0, "Channel Model"="AWGN"}
types:
  T1 = cluster{"Noise Power (dB)": f64, "Channel Response": c128[], "Frequency Offset": f64, "Delay (sec)": f64, "Channel Model": string}
  T2 = cluster{"Noise Power (dB)": f64, "Channel Response h_11": c128[], "Frequency Offset": f64, "Delay (sec)": f64, "Channel Model": string, "Channel Response h_12": c128[], "Channel Response h_21": c128[], "Channel Response h_22": c128[]}
diagram:
  Property Node(instance in=$"Channel Model Parameters") -> ("Noise Power (dB)"=w1, "Channel Response h_11"=w2, "Frequency Offset"=w3, "Delay (sec)"=w4, "Channel Model"=w5, "Channel Response h_12"=w6, "Channel Response h_21"=w7, "Channel Response h_22"=w8)
  Property Node(instance in=$"Single channel template", "Noise Power (dB)"=w1, "Channel Response"=w2, "Frequency Offset"=w3, "Delay (sec)"=w4, "Channel Model"=w5) -> (instance out=w9)
  $"Channel Model Parameters h_11" <- w9
  Property Node(instance in=$"Single channel template", "Noise Power (dB)"=w1, "Channel Response"=w6, "Frequency Offset"=w3, "Delay (sec)"=w4, "Channel Model"=w5) -> (instance out=w10)
  $"Channel Model Parameters h_12" <- w10
  Property Node(instance in=$"Single channel template", "Noise Power (dB)"=w1, "Channel Response"=w7, "Frequency Offset"=w3, "Delay (sec)"=w4, "Channel Model"=w5) -> (instance out=w11)
  $"Channel Model Parameters h_21" <- w11
  Property Node(instance in=$"Single channel template", "Noise Power (dB)"=w1, "Channel Response"=w8, "Frequency Offset"=w3, "Delay (sec)"=w4, "Channel Model"=w5) -> (instance out=w12)
  $"Channel Model Parameters h_22" <- w12
