vi "top_tx_MIMO.gvi"   [LabVIEW NXG]
inputs:
  "HW Parameters": T2 = {"Active Antenna"="TX1", "Carrier Frequency (Hz)"=915000000, "Gain (dB)"=10, "Generation Mode"="Continuous", "Device IP Address"="192.168.10.3"}
  "Modulation Parameters": T6 = {"Modulation Type"="QPSK", "Pulse Shaping Parameters"={"Modulation Type"="PSK", "Pulse Shaping Filter"="Raised Cosine", "Filter Parameter"=0.5, "Filter Length (Symbols)"=8}, "TX Oversample Factor"=20, "Packet Length (Bits)"=500, "TX Sample Rate"=4000000, "Control Information For Packet Header/Tail"={"Training Sequences "="Zadoff Chu", "Zero Pad Length"=8}}
  "OFDM Parameters In": T7 = {"FFT size (N)"=64, "Length of CP (Lc)"=8, "Null Tones"=[0, 30, 31, 32], "Number of OFDM Symbols (derived)"=1, "Training Sequence FFT size"=0, "Training Sequence Length of CP"=0, "Number of null tones"=0}
  "error in": error
outputs:
  "Queue Out": cluster{"Key Bit Sequence": Queue<u8[]>}
  "error out": error
  "Transmitting": bool
  "packet duration (sec)": f64
  "Output IQ Waveform 1": cluster{"t0": f64, "dt": f64, "Y": c128[]}
  "Output IQ Waveform 2": cluster{"t0": f64, "dt": f64, "Y": c128[]}
panel controls:
  "STOP": bool
  "Plots": i32
  "Parameters": i32
  "Plots_2": i32
panel indicators:
  "symbol rate (Hz)": f64
  "key bit sequence": i8[]
  "coerced carrier frequency (Hz)": f64
  "coerced gain (dB)": f64
  "number of data symbols": i32
  "Eye Diagram 1": cluster{"t0": f64, "dt": f64, "Y": f64[]}[]
  "Transmitted Constellation 1": T1[]
  "Transmitted Constellation 2": T1[]
  "Eye Diagram 2": cluster{"t0": f64, "dt": f64, "Y": f64[]}[]
types:
  T1 = cluster{"constellation": f64[], "oversampled data": f64[]}
  T2 = cluster{"Active Antenna": string, "Carrier Frequency (Hz)": f64, "Gain (dB)": f64, "Generation Mode": enum{"Single Shot", "Simulate", "Continuous"}, "Device IP Address": string}
  T3 = enum{"none", "Raised Cosine", "Root Raised Cos", "Gaussian"}
  T4 = cluster{"Modulation Type": enum{"FSK", "PSK", "QAM", "MSK", "PAM", "ASK"}, "Pulse Shaping Filter": T3, "Filter Parameter": f64, "Filter Length (Symbols)": i32}
  T5 = cluster{"Training Sequences ": string, "Zero Pad Length": i32}
  T6 = cluster{"Modulation Type": string, "Pulse Shaping Parameters": T4, "TX Oversample Factor": i32, "Packet Length (Bits)": i32, "TX Sample Rate": f64, "Control Information For Packet Header/Tail": T5}
  T7 = cluster{"FFT size (N)": i32, "Length of CP (Lc)": i32, "Null Tones": u32[], "Number of OFDM Symbols (derived)": i32, "Training Sequence FFT size": i32, "Training Sequence Length of CP": i32, "Number of null tones": i32}
diagram:
  case ($"error in") {
    frame No Error {
      call "TXRF_init_MIMO.gvi"(HW Parameters In=$"HW Parameters", Modulation Parameters In=$"Modulation Parameters", error in=$"error in") -> (error out=w3, HW Parameters Out=w4, Modulation Parameters Out=w5, queue out=w6, coerced carrier frequency (Hz)=w7, coerced gain (dB)=w8, USRP Session out=w9)
      call "transmitter_MIMO.gvi"(HW Parameters In=w4, Modulation Parameters In=w5, OFDM Parameters In=$"OFDM Parameters In", error in=w3, queue in=w6) -> (error out=w10, HW Parameters Out=w11, Modulation Parameters Out=w12, Output conplex waveform 1=w13, Number of Data Symbols=w14, Key Bit Sequence=w15, queue out=w16, Eye Diagram 1=w17, Transmitted Constellation 1=w18, Output complex waveform 2=w19, Eye Diagram 2=w20, Transmitted Constellation 2=w21)
      $"key bit sequence" <- w15
      $"Eye Diagram 1" <- w17
      $"Eye Diagram 2" <- w20
      Property Node(instance in=w12) -> ("TX Oversample Factor"=w22, "TX Sample Rate"=w23)
      Divide(x=w23, y=w22) -> w24
      $"symbol rate (Hz)" <- w24
      Property Node(instance in=w13) -> ("Y"=w25)
      Array Size(array=w25) -> (size(s)=w26)
      Divide(x=w26, y=w23) -> w27
      $"packet duration (sec)" <- w27
      Property Node(instance in=w11) -> ("Generation Mode"=w28)
      case (w28) {
        frame "Single Shot" {
          call "TXRF_prepare_for_transmit_MIMO.gvi"(IQ Data_2=w19, IQ Data=w13, error in=w10) -> (Scaled and Padded IQ Data_2=w29, Scaled and Padded IQ Data=w30, error out=w31)
          call "TXRF_send_MIMO.gvi"(USRP Session in=w9, error in=w31, IQ Data in=w30, end of data?=TRUE, HW Parameters In=w11, IQ Data in_2=w29) -> (error out=w32, USRP Session out=w33)
          call "niUSRP Close Session.gvi"(Handle in=w33, error in (no error)=w32) -> (Error Out=w1)
        }
        frame "Simulate" {
          w1 = default
        }
        frame "Continuous", Default {
          call "TXRF_prepare_for_transmit_MIMO.gvi"(IQ Data_2=w19, IQ Data=w13, error in=w10) -> (Scaled and Padded IQ Data_2=w34, Scaled and Padded IQ Data=w35, error out=w36)
          while {
            Not(x=TRUE) -> w37
            $Transmitting <- TRUE
            call "TXRF_send_MIMO.gvi"(USRP Session in=w9, error in=w36, IQ Data in=w35, end of data?=FALSE, HW Parameters In=w11, IQ Data in_2=w34) -> (error out=w38, USRP Session out=w39)
            Property Node(instance in=w38) -> ("status"=w40)
            Logical Or(w40, $STOP) -> w41
            stop if w41
          }
          $Transmitting <- w37
          call "niUSRP Close Session.gvi"(Handle in=w39, error in (no error)=w38) -> (Error Out=w1)
        }
      }
      $"Output IQ Waveform 1" <- w13
      $"Output IQ Waveform 2" <- w19
      $"Queue Out" <- w16
      $"Transmitted Constellation 1" <- w18
      $"Transmitted Constellation 2" <- w21
      $"number of data symbols" <- w14
      $"coerced carrier frequency (Hz)" <- w7
      $"coerced gain (dB)" <- w8
      w2 = FALSE
    }
    frame Error {
      w1 = $"error in"
      w2 = FALSE
    }
  }
  $STOP <- w2
  $"error out" <- w1
