vi "RXRF_trigger_and_capture_MIMO.gvi"   [LabVIEW NXG]
inputs:
  "USRP Session In": niUSRP
  "trigger level": f64
  "Reference Position": f64
  "error in (no error)": error
  "number of samples": i64 = -1
outputs:
  "USRP Session out": niUSRP
  "IQ Waveform_2": cluster{"t0": f64, "dt": f64, "Y": c128[]}
  "IQ Waveform": cluster{"t0": f64, "dt": f64, "Y": c128[]}
  "packet found": bool
  "error out": error
diagram:
  case ($"error in (no error)") {
    frame No Error {
      Multiply($"Reference Position", 0.01) -> w2
      Multiply(w2, $"number of samples") -> w3
      Round To Nearest(number=w3) -> w4
      # NOTE: The value 40
      # represents the approx. size
      #  of the initial RX transient
      #  in samples.
      # Collect enough data to fill the
      # prefetch portion plus enough
      # to skip the RX transient
      call "niUSRP Fetch Rx Data (2D CDB).gvi"(session handle=$"USRP Session In", number of samples=40, error in (no error)=$"error in (no error)") -> (session handle out=w5, Error Out=w6)
      call "niUSRP Fetch Rx Data (2D CDB).gvi"(session handle=w5, number of samples=$"number of samples", error in (no error)=w6) -> (session handle out=w7, data=w8, Error Out=w9)
      Tick Count() -> (millisecond timer value=w10)
      # Check to see if the magnitude of the received data
      # surpasses the threshold
      # # of pre-trigger samples
      # current data
      # previous data
      s1 = w8  # shift register
      while {
        call "niUSRP Fetch Rx Data (2D CDB).gvi"(session handle=w7, number of samples=$"number of samples", error in (no error)=w9) -> (session handle out=w12, data=w13, Error Out=w14)
        Array Size(array=w13) -> (size(s)=w15)
        Array Index(array=w15) -> (out0[1]=w16)
        Initialize Array(element=0, size=w16) -> w17
        s2 = w17  # shift register
        for {
          w18 = each element of w13
          Complex To Polar(r * e^(i*theta)=w18) -> (r=w19)
          Add(s2, w19) -> w20
          next s2 = w20
        }
        call "Threshold Detector.gvi"(x=s2, threshold=$"trigger level") -> (indices=w21, count=w22)
        Is Greater Than 0(x=w22) -> w23
        $"packet found" <- w23
        Property Node(instance in=w14) -> ("status"=w24)
        Add(w10, 100) -> w25
        Tick Count() -> (millisecond timer value=w26)
        Is Greater(x=w26, y=w25) -> w27
        Logical Or(w24, w23, w27) -> w28
        w11 = s1
        next s1 = w13
        stop if w28
      }
      # first index is
      # the trigger point
      Array Index(array=w21) -> (out0[0]=w29)
      Add(w29, 1) -> w30
      Subtract(x=w30, y=w4) -> w31
      Is Greater Than 0(x=w31) -> w32
      # check if we need data from the previous fetch
      # or data from the next fetch to complete the
      # number of samples requested
      # # of samples to get from new fetch
      # trigger level
      # number of samples
      case (w32) {
        frame False, Default {
          Transpose 2D Array(2D array=s1) -> (transposed array=w36)
          Transpose 2D Array(2D array=w11) -> (transposed array=w37)
          Build Array[ConcatenateInputs=True](w37, w36) -> w38
          Transpose 2D Array(2D array=w38) -> (transposed array=w39)
          Array Size(array=w39) -> (size(s)=w40)
          Array Index(array=w40) -> (out0[1]=w41)
          Initialize Array(element=0, size=w41) -> w42
          s3 = w42  # shift register
          for {
            w43 = each element of w39
            Complex To Polar(r * e^(i*theta)=w43) -> (r=w44)
            Add(s3, w44) -> w45
            next s3 = w45
          }
          call "Threshold Detector.gvi"(x=s3, threshold=$"trigger level") -> (indices=w46)
          Array Index(array=w46) -> (out0[0]=w47)
          Subtract(x=w47, y=w4) -> w48
          Array Subset(array=w39, index1=w48, length1=$"number of samples") -> w49
          Complex To Real Imaginary(x + iy=w49) -> (x=w50)
          Add(w50, w50)
          # first index is
          # the trigger point
          Array Subset(array=w49, index0=0, length0=1, index1=0) -> w51
          Reshape Array(inArray=w51, size=$"number of samples") -> w52
          w53 = cluster{"t0": f64, "dt": f64, "Y": c128[]} {all zero or empty}
          Property Node(instance in=w53, "Y"=w52) -> (instance out=w34)
          Array Subset(array=w49, index0=1, length0=1, index1=0) -> w54
          Reshape Array(inArray=w54, size=$"number of samples") -> w55
          w56 = cluster{"t0": f64, "dt": f64, "Y": c128[]} {all zero or empty}
          Property Node(instance in=w56, "Y"=w55) -> (instance out=w35)
          w33 = w12
          w1 = w14
        }
        frame True {
          # need to fetch next set of data
          Transpose 2D Array(2D array=s1) -> (transposed array=w57)
          call "niUSRP Fetch Rx Data (2D CDB).gvi"(session handle=w12, number of samples=w31, error in (no error)=w14) -> (session handle out=w33, data=w58, Error Out=w1)
          Transpose 2D Array(2D array=w58) -> (transposed array=w59)
          Build Array[ConcatenateInputs=True](w57, w59) -> w60
          Transpose 2D Array(2D array=w60) -> (transposed array=w61)
          Array Subset(array=w61, index1=w31, length1=$"number of samples") -> w62
          Complex To Real Imaginary(x + iy=w62) -> (x=w63)
          Add(w63, w63)
          Array Subset(array=w62, index0=0, length0=1, index1=0) -> w64
          Reshape Array(inArray=w64, size=$"number of samples") -> w65
          Complex To Real Imaginary(x + iy=w65) -> (x=w66)
          Add(w66, w66)
          Complex To Real Imaginary(x + iy=w61) -> (x=w67)
          Add(w67, w67)
          w68 = cluster{"t0": f64, "dt": f64, "Y": c128[]} {all zero or empty}
          Property Node(instance in=w68, "Y"=w65) -> (instance out=w34)
          Array Subset(array=w62, index0=1, length0=1, index1=0) -> w69
          Reshape Array(inArray=w69, size=$"number of samples") -> w70
          w71 = cluster{"t0": f64, "dt": f64, "Y": c128[]} {all zero or empty}
          Property Node(instance in=w71, "Y"=w70) -> (instance out=w35)
        }
      }
      $"IQ Waveform" <- w34
      $"IQ Waveform_2" <- w35
      $"USRP Session out" <- w33
    }
    frame Error {
      w1 = $"error in (no error)"
    }
  }
  $"error out" <- w1
