vi "SVD_RX.gvi"   [LabVIEW NXG]
inputs:
  "Input Complex Symbols 1": c128[]
  "Input Complex Symbols 2": c128[]
  "Modulation Parameters In": T6 = {"Modulation Type"="QPSK", "Control Information\nfor Packet Header/Tail"={"Training Sequence 1 (derived)"=[], "Zero Pad Length"=0, "Training Sequence 2 (derived)"=[]}, "RX Oversample Factor"=20, "Synchronization Options"={"Synchronization Method"="Timing Estimation", "Fixed Offset"=0, "Symbol Timing Recovery Method"="Max Energy", "Frame Detection Method"="Sliding Correlator", "Correct Frequency Offset"=FALSE}, "Number of Data Symbols (Derived)"=250, "RX Sample Rate"=4000000, "Pulse Shaping Parameters"={"Modulation Type"="PSK", "Pulse Shaping Filter"="Raised Cosine", "Filter Parameter"=0.5, "Filter Length (Symbols)"=8}, "Channel Estimation/Equalization Parameters"={"Equalization Method"="Direct", "Channel Estimate Length"=4, "Equalizer Length"=4, "Equalizer Delay"=-1}}
  "Channel estimates": T7
  "error in (no error)": error
outputs:
  "error out": error
  "Output Complex Symbols": c128[]
  "Modulation Parameters Out": T6
panel indicators:
  "matrix s": c128[][]
  "matrix v": c128[][]
types:
  T1 = cluster{"Training Sequence 1 (derived)": c128[], "Zero Pad Length": i32, "Training Sequence 2 (derived)": c128[]}
  T2 = cluster{"Synchronization Method": string, "Fixed Offset": i32, "Symbol Timing Recovery Method": string, "Frame Detection Method": string, "Correct Frequency Offset": bool}
  T3 = enum{"none", "Raised Cosine", "Root Raised Cos", "Gaussian"}
  T4 = cluster{"Modulation Type": enum{"FSK", "PSK", "QAM", "MSK", "PAM", "ASK"}, "Pulse Shaping Filter": T3, "Filter Parameter": f64, "Filter Length (Symbols)": i32}
  T5 = cluster{"Equalization Method": string, "Channel Estimate Length": i32, "Equalizer Length": i32, "Equalizer Delay": i32}
  T6 = cluster{"Modulation Type": string, "Control Information\nfor Packet Header/Tail": T1, "RX Oversample Factor": i32, "Synchronization Options": T2, "Number of Data Symbols (Derived)": i32, "RX Sample Rate": f64, "Pulse Shaping Parameters": T4, "Channel Estimation/Equalization Parameters": T5}
  T7 = cluster{"Element 1": c128[], "Element 2": c128[], "Element 3": c128[], "Element 4": c128[]}
diagram:
  Property Node(instance in=$"Channel estimates") -> ("Element 1"=w1, "Element 2"=w2, "Element 3"=w3, "Element 4"=w4)
  Array Index(array=w1) -> (out0[0]=w5)
  Array Index(array=w2) -> (out0[0]=w6)
  Build Array(w5, w6) -> w7
  Array Index(array=w3) -> (out0[0]=w8)
  Array Index(array=w4) -> (out0[0]=w9)
  Build Array(w8, w9) -> w10
  Build Array(w7, w10) -> w11
  call "Complex SVD Decomposition.gvi"(a=w11) -> (matrix u=w12, matrix s=w13, matrix v=w14, vector s=w15)
  $"matrix s" <- w13
  $"matrix v" <- w14
  Array Index(array=w15) -> (out0[0]=w16)
  # y0,y2,y4
  # y1,y3,y5
  Build Array($"Input Complex Symbols 1", $"Input Complex Symbols 2") -> w17
  # U
  call "Complex Conjugate Transpose Matrix.gvi"(input matrix=w12) -> (matrix conjugate transpose=w18)
  # U*
  Complex Conjugate(x + iy=w18) -> w19
  # U*Y
  call "Complex A x B.gvi"(A=w19, B=w17) -> (A x B=w20)
  Array Index(array=w20) -> (out0[0, _]=w21)
  Divide(x=w21, y=w16) -> w22
  Array Index(array=w15) -> (out0[1]=w23)
  Array Index(array=w20) -> (out0[1, _]=w24)
  Divide(x=w24, y=w23) -> w25
  Interleave Array(w22, w25) -> w26
  $"Output Complex Symbols" <- w26
  $"error out" <- $"error in (no error)"
  $"Modulation Parameters Out" <- $"Modulation Parameters In"
