vi "SVD_TX.gvi"   [LabVIEW NXG]
inputs:
  "error in (no error)": error
  "input symbols": c128[] = [1+0i, 2+0i, 3+0i, 4+0i, 0.707106781187+0.707106781187i, -0.707106781187+0.707106781187i, 0.707106781187+0.707106781187i, -0.707106781187-0.707106781187i, -0.707106781187+0.707106781187i, 0.707106781187+0.707106781187i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]
  "Modulation Parameters In": T4 = {"Modulation Type"="QPSK", "Pulse Shaping Parameters"={"Modulation Type"="PSK", "Pulse Shaping Filter"="Raised Cosine", "Filter Parameter"=0.5, "Filter Length (Symbols)"=8}, "TX Oversample Factor"=20, "Packet Length (Bits)"=500, "TX Sample Rate"=100, "Control Information For Packet Header/Tail"={"Training Sequences"="Length 11 Barker Sequence", "Zero Pad Length"=8}}
  "Channel Model Parameters": T7 = {"Noise Power (dB)"=-Inf, "Channel Model"="AWGN"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}
outputs:
  "error out": error
  "Modulation Parameters Out": T6
  "output 1": c128[]
  "output 2": c128[]
panel indicators:
  "matrix u": c128[][]
  "matrix s": c128[][]
types:
  T1 = enum{"none", "Raised Cosine", "Root Raised Cos", "Gaussian"}
  T2 = cluster{"Modulation Type": enum{"FSK", "PSK", "QAM", "MSK", "PAM", "ASK"}, "Pulse Shaping Filter": T1, "Filter Parameter": f64, "Filter Length (Symbols)": i32}
  T3 = cluster{"Training Sequences": string, "Zero Pad Length": i32}
  T4 = cluster{"Modulation Type": string, "Pulse Shaping Parameters": T2, "TX Oversample Factor": i32, "Packet Length (Bits)": i32, "TX Sample Rate": f64, "Control Information For Packet Header/Tail": T3}
  T5 = cluster{"Training Sequences ": string, "Zero Pad Length": i32}
  T6 = cluster{"Modulation Type": string, "Pulse Shaping Parameters": T2, "TX Oversample Factor": i32, "Packet Length (Bits)": i32, "TX Sample Rate": f64, "Control Information For Packet Header/Tail": T5}
  T7 = cluster{"Noise Power (dB)": f64, "Channel Response h_11": c128[], "Frequency Offset": f64, "Delay (sec)": f64, "Channel Model": string, "Channel Response h_12": c128[], "Channel Response h_21": c128[], "Channel Response h_22": c128[]}
diagram:
  $"error out" <- $"error in (no error)"
  case ($"error in (no error)") {
    frame No Error {
      Decimate Array(array=$"input symbols") -> (out0=w3, out1=w4)
      # x0,x2,x4...
      # x1,x3,x5...
      Build Array(w3, w4) -> w5
      Property Node(instance in=$"Channel Model Parameters") -> ("Channel Response h_11"=w6, "Channel Response h_12"=w7, "Channel Response h_21"=w8, "Channel Response h_22"=w9)
      Array Index(array=w6) -> (out0[0]=w10)
      Array Index(array=w7) -> (out0[0]=w11)
      Build Array(w10, w11) -> w12
      Array Index(array=w9) -> (out0[0]=w13)
      Array Index(array=w8) -> (out0[0]=w14)
      Build Array(w14, w13) -> w15
      Build Array(w12, w15) -> w16
      # V*
      call "Complex SVD Decomposition.gvi"(a=w16) -> (matrix u=w17, matrix s=w18, matrix v=w19)
      call "Complex Conjugate Transpose Matrix.gvi"(input matrix=w19) -> (matrix conjugate transpose=w20)
      # V
      Complex Conjugate(x + iy=w20) -> w21
      # V*x
      call "Complex A x B.gvi"(A=w21, B=w5) -> (A x B=w22)
      Array Index(array=w22) -> (out0[0, _]=w1)
      Array Index(array=w22) -> (out0[1, _]=w2)
      $"matrix u" <- w17
      $"matrix s" <- w18
    }
    frame Error {
      w1 = default
      w2 = default
    }
  }
  $"output 1" <- w1
  $"output 2" <- w2
  $"Modulation Parameters Out" <- $"Modulation Parameters In"
