vi "transmitter_init (SubVI).gvi"   [LabVIEW NXG]
inputs:
  "Modulation Parameters In": T4 = {"Modulation Type"="QPSK", "Pulse Shaping Parameters"={"Modulation Type"="PSK", "Pulse Shaping Filter"="Root Raised Cos", "Filter Parameter"=0.5, "Filter Length (Symbols)"=8}, "TX Oversample Factor"=20, "Packet Length (Bits)"=500, "TX Sample Rate"=100, "Control Information For Packet Header/Tail"={"Training Sequences "="Length 11 Barker Sequence", "Zero Pad Length"=8}}
outputs:
  "symbol rate": f64
  "number of data symbols": i32
types:
  T1 = enum{"none", "Raised Cosine", "Root Raised Cos", "Gaussian"}
  T2 = cluster{"Modulation Type": enum{"FSK", "PSK", "QAM", "MSK", "PAM", "ASK"}, "Pulse Shaping Filter": T1, "Filter Parameter": f64, "Filter Length (Symbols)": i32}
  T3 = cluster{"Training Sequences ": string, "Zero Pad Length": i32}
  T4 = cluster{"Modulation Type": string, "Pulse Shaping Parameters": T2, "TX Oversample Factor": i32, "Packet Length (Bits)": i32, "TX Sample Rate": f64, "Control Information For Packet Header/Tail": T3}
diagram:
  Property Node(instance in=$"Modulation Parameters In") -> ("TX Sample Rate"=w1, "TX Oversample Factor"=w2)
  Divide(x=w1, y=w2) -> w3
  $"symbol rate" <- w3
  Property Node(instance in=$"Modulation Parameters In") -> ("Modulation Type"=w4, "Packet Length (Bits)"=w5)
  case (w4) {
    frame "BPSK", Default {
      w6 = w5
    }
    frame "QPSK" {
      Quotient And Remainder(x=w5, y=2) -> (floor(x/y)=w6)
    }
  }
  $"number of data symbols" <- w6
