vi "student_toeplitz.gvi"   [LabVIEW NXG]
inputs:
  "Row": c128[]
  "Column": c128[]
outputs:
  "Toeplitz Array": c128[][]
diagram:
  Array Size(array=$Column) -> (size(s)=w1)
  # nb de colonnes
  Array Size(array=$Row) -> (size(s)=w2)
  for (N = w2) (iteration -> i1) {
    Subtract(x=w1, y=i1) -> w4
    Array Subset(array=$Column, index0=0, length0=w4) -> w5
    Array Subset(array=$Row, index0=1, length0=i1) -> w6
    Reverse 1D Array(array=w6) -> (reversed array=w7)
    Insert Into Array(inArray=w7, index0=i1, new=w5) -> w8
    append w8 to w3
  }
  Transpose 2D Array(2D array=w3) -> (transposed array=w9)
  $"Toeplitz Array" <- w9
