vi "test.gvi"   [LabVIEW NXG]
panel controls:
  "array": f64[]
panel indicators:
  "matrix u": c128[][]
  "matrix s": c128[][]
  "matrix v": c128[][]
  "vector s": f64[]
  "matrix transpose": c128[][]
  "x - yi": c128[][]
  "subarray": f64[]
  "subarray_2": f64[]
  "A x B": c128[][]
diagram:
  Decimate Array(array=$array) -> (out0=w1, out1=w2)
  Build Array(w1, w2) -> w3
  Array Index(array=w3) -> (out0[1, _]=w4)
  $subarray <- w4
  Array Index(array=w3) -> (out0[0, _]=w5)
  $subarray_2 <- w5
  Build Array(3, 4) -> w6
  Build Array(1+0i, 2+0i) -> w7
  Build Array(w7, w6) -> w8
  call "Complex SVD Decomposition.gvi"(a=w8) -> (matrix u=w9, matrix s=w10, matrix v=w11, vector s=w12)
  $"vector s" <- w12
  call "Complex A x B.gvi"(A=w8, B=w8) -> (A x B=w13)
  $"A x B" <- w13
  $"matrix u" <- w9
  $"matrix s" <- w10
  $"matrix v" <- w11
  call "Complex Conjugate Transpose Matrix.gvi"(input matrix=w8) -> (matrix conjugate transpose=w14)
  $"matrix transpose" <- w14
  Complex Conjugate(x + iy=w8) -> w15
  $"x - yi" <- w15
