vi "transmitter_MIMO.gvi"   [LabVIEW NXG]
inputs:
  "HW Parameters In": T2 = {"Active Antenna"="TX1", "Carrier Frequency (Hz)"=915000000, "Gain (dB)"=10, "Generation Mode"="Continuous", "Device IP Address"="192.168.10.3"}
  "Modulation Parameters In": T6 = {"Modulation Type"="QPSK", "Pulse Shaping Parameters"={"Modulation Type"="PSK", "Pulse Shaping Filter"="Raised Cosine", "Filter Parameter"=0.5, "Filter Length (Symbols)"=8}, "TX Oversample Factor"=20, "Packet Length (Bits)"=500, "TX Sample Rate"=100, "Control Information For Packet Header/Tail"={"Training Sequences "="Zadoff Chu", "Zero Pad Length"=8}}
  "Channel Model Parameters": T8 = {"Noise Power (dB)"=-Inf, "Channel Model"="AWGN"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}
  "error in": error
  "queue in": cluster{"Key Bit Sequence": Queue<u8[]>}
outputs:
  "error out": error
  "HW Parameters Out": T2
  "Modulation Parameters Out": T6
  "Output conplex waveform 1": cluster{"t0": f64, "dt": f64, "Y": c128[]}
  "Number of Data Symbols": i32
  "Key Bit Sequence": i8[]
  "queue out": cluster{"Key Bit Sequence": Queue<u8[]>}
  "Eye Diagram 1": cluster{"t0": f64, "dt": f64, "Y": f64[]}[]
  "Transmitted Constellation 1": T1[]
  "Output complex waveform 2": cluster{"t0": f64, "dt": f64, "Y": c128[]}
  "Eye Diagram 2": cluster{"t0": f64, "dt": f64, "Y": f64[]}[]
  "Transmitted Constellation 2": T1[]
panel controls:
  "Tab": i32
  "Tab_2": i32
  "Training Sequences In": T7 = {"Length 11 Zadoff Chu 1 "=[1+0i, 1+0i, 1+0i, -1+0i, 1+0i, 1+0i, -1+0i, 1+0i, -1+0i, -1+0i, -1+0i], "Length 11 Zadoff Chu 2"=[1+0i, -1+0i, 1+0i, 1+0i, -1+0i, 1+0i, -1+0i, -1+0i, -1+0i, 1+0i, 1+0i]}
types:
  T1 = cluster{"constellation": f64[], "oversampled data": f64[]}
  T2 = cluster{"Active Antenna": string, "Carrier Frequency (Hz)": f64, "Gain (dB)": f64, "Generation Mode": enum{"Single Shot", "Simulate", "Continuous"}, "Device IP Address": string}
  T3 = enum{"none", "Raised Cosine", "Root Raised Cos", "Gaussian"}
  T4 = cluster{"Modulation Type": enum{"FSK", "PSK", "QAM", "MSK", "PAM", "ASK"}, "Pulse Shaping Filter": T3, "Filter Parameter": f64, "Filter Length (Symbols)": i32}
  T5 = cluster{"Training Sequences ": string, "Zero Pad Length": i32}
  T6 = cluster{"Modulation Type": string, "Pulse Shaping Parameters": T4, "TX Oversample Factor": i32, "Packet Length (Bits)": i32, "TX Sample Rate": f64, "Control Information For Packet Header/Tail": T5}
  T7 = cluster{"Length 11 Zadoff Chu 1 ": c128[], "Length 11 Zadoff Chu 2": c128[]}
  T8 = cluster{"Noise Power (dB)": f64, "Channel Response h_11": c128[], "Frequency Offset": f64, "Delay (sec)": f64, "Channel Model": string, "Channel Response h_12": c128[], "Channel Response h_21": c128[], "Channel Response h_22": c128[]}
diagram:
  case ($"error in") {
    frame No Error {
      call "transmitter_init (SubVI).gvi"(Modulation Parameters In=$"Modulation Parameters In") -> (symbol rate=w3, number of data symbols=w4)
      call "source.gviprotected"(Modulation Parameters In=$"Modulation Parameters In", error in (no error)=$"error in") -> (Modulation Parameters Out=w5, output bit stream=w6, error out=w7)
      call "modulate.gviprotected"(Modulation Parameters In=w5, input bit stream=w6, error in (no error)=w7) -> (Modulation Parameters Out=w8, output symbols=w9, error out=w10)
      call "SVD_TX.gvi"(error in (no error)=w10, input symbols=w9, Modulation Parameters In=w8, Channel Model Parameters=$"Channel Model Parameters") -> (error out=w11, Modulation Parameters Out=w12, output 1=w13, output 2=w14)
      call "Training_sequence_preprocessing.gviprotected"(Training Sequences in=$"Training Sequences In", error in (no error)=w11) -> (Training Sequences out=w15, error out=w16)
      call "add_control_MIMO.gviprotected"(error in (no error)=w16, input 1=w13, Modulation Parameters In=w12, Training Sequences=w15, input 2=w14) -> (error out=w17, output 1=w18, Modulation Parameters Out=w19, output 2=w20)
      call "transmitter_enque (SubVI).gvi"(queue in=$"queue in", error in=w17, key bit stream 1=w6) -> (error out=w21, queue out=w22)
      call "pulse_shaping.gviprotected"(Modulation Parameters In=w19, input 1=w18, input 2=w20, error in (no error)=w21) -> (Modulation Parameters Out=w2, output 1=w23, output 2=w24, error out=w1)
      Property Node(instance in=w2) -> ("TX Sample Rate"=w25)
      Reciprocal(x=w25) -> w26
      call "make_MTwaveform.gvi"(dt=w26, Y=w23) -> (output MT waveform=w27)
      call "transmitter_generate_waveforms (SubVI).gvi"(complex waveform=w27, symbol rate (Hz)=w3, Y=w13) -> (transmitted constellation=w28, eye diagram=w29)
      $"Transmitted Constellation 1" <- w28
      # generate plots
      $"Eye Diagram 1" <- w29
      call "make_MTwaveform.gvi"(dt=w26, Y=w24) -> (output MT waveform=w30)
      call "transmitter_generate_waveforms (SubVI).gvi"(complex waveform=w30, symbol rate (Hz)=w3, Y=w14) -> (transmitted constellation=w31, eye diagram=w32)
      $"Transmitted Constellation 2" <- w31
      $"Eye Diagram 2" <- w32
      $"Number of Data Symbols" <- w4
      $"Key Bit Sequence" <- w6
      $"Output conplex waveform 1" <- w27
      $"Output complex waveform 2" <- w30
      $"queue out" <- w22
    }
    frame Error {
      w1 = $"error in"
      w2 = $"Modulation Parameters In"
    }
  }
  $"Modulation Parameters Out" <- w2
  $"error out" <- w1
  $"HW Parameters Out" <- $"HW Parameters In"
