vi "receiver_init (SubVI).gvi"   [LabVIEW NXG]
inputs:
  "Modulation Parameters In": T6 = {"Modulation Type"="QPSK", "Control Information\nfor Packet Header/Tail"={"Training Sequence 1 (derived)"=[], "Zero Pad Length"=0, "Training Sequence 2 (derived)"=[]}, "RX Oversample Factor"=20, "Synchronization Options"={"Synchronization Method"="Timing Estimation", "Fixed Offset"=0, "Symbol Timing Recovery Method"="Max Energy", "Frame Detection Method"="Sliding Correlator", "Correct Frequency Offset"=FALSE}, "Number of Data Symbols (Derived)"=100, "RX Sample Rate"=4000000, "Pulse Shaping Parameters"={"Modulation Type"="PSK", "Pulse Shaping Filter"="Root Raised Cos", "Filter Parameter"=0.5, "Filter Length (Symbols)"=8}, "Channel Estimation/Equalization Parameters"={"Equalization Method"="Direct", "Channel Estimate Length"=1, "Equalizer Length"=1, "Equalizer Delay"=-1}}
  "queue in": cluster{"Key Bit Sequence": Queue<u8[]>}
  "error in": error
  "Training Sequences": T7 = {"Training sequence 1 "=[1+0i, 1+0i, 1+0i, 0+0i, 1+0i, 1+0i, 0+0i, 1+0i, 0+0i, 0+0i, 0+0i], "Training sequence 2"=[1+0i, 0+0i, 1+0i, 1+0i, 0+0i, 1+0i, 0+0i, 0+0i, 0+0i, 1+0i, 1+0i]}
outputs:
  "Modulation Parameters Out": T6
  "queue out": cluster{"Key Bit Sequence": Queue<u8[]>}
  "symbol rate": f64
  "key bit sequence": i8[]
  "overhead offset": i32
  "error out": error
types:
  T1 = cluster{"Training Sequence 1 (derived)": c128[], "Zero Pad Length": i32, "Training Sequence 2 (derived)": c128[]}
  T2 = cluster{"Synchronization Method": string, "Fixed Offset": i32, "Symbol Timing Recovery Method": string, "Frame Detection Method": string, "Correct Frequency Offset": bool}
  T3 = enum{"none", "Raised Cosine", "Root Raised Cos", "Gaussian"}
  T4 = cluster{"Modulation Type": enum{"FSK", "PSK", "QAM", "MSK", "PAM", "ASK"}, "Pulse Shaping Filter": T3, "Filter Parameter": f64, "Filter Length (Symbols)": i32}
  T5 = cluster{"Equalization Method": string, "Channel Estimate Length": i32, "Equalizer Length": i32, "Equalizer Delay": i32}
  T6 = cluster{"Modulation Type": string, "Control Information\nfor Packet Header/Tail": T1, "RX Oversample Factor": i32, "Synchronization Options": T2, "Number of Data Symbols (Derived)": i32, "RX Sample Rate": f64, "Pulse Shaping Parameters": T4, "Channel Estimation/Equalization Parameters": T5}
  T7 = cluster{"Training sequence 1 ": c128[], "Training sequence 2": c128[]}
diagram:
  Property Node(instance in=$"queue in") -> (instance out=w1, "Key Bit Sequence"=w2)
  $"queue out" <- w1
  Property Node(instance in=$"Training Sequences") -> ("Training sequence 1 "=w3, "Training sequence 2"=w4)
  Property Node(instance in=$"Modulation Parameters In") -> ("Modulation Type"=w5, "RX Sample Rate"=w6, "RX Oversample Factor"=w7)
  Preview Queue Element(error in (no error)=$"error in", queue=w2, timeout in ms (-1)=100) -> (element=w8, error out=w9)
  Array Size(array=w8) -> (size(s)=w10)
  case (w5) {
    frame "BPSK", Default {
      w11 = w10
    }
    frame "QPSK" {
      Quotient And Remainder(x=w10, y=2) -> (floor(x/y)=w11)
    }
  }
  Property Node(instance in=$"Modulation Parameters In", "Control Information\nfor Packet Header/Tail:Training Sequence 1 (derived)"=w3, "Control Information\nfor Packet Header/Tail:Training Sequence 2 (derived)"=w4, "Number of Data Symbols (Derived)"=w11) -> (instance out=w12)
  $"Modulation Parameters Out" <- w12
  $"key bit sequence" <- w8
  $"error out" <- w9
  Divide(x=w6, y=w7) -> w13
  $"symbol rate" <- w13
  Property Node(instance in=$"Modulation Parameters In") -> ("Pulse Shaping Parameters:Filter Length (Symbols)"=w14, "RX Oversample Factor"=w15)
  Quotient And Remainder(x=w14, y=2) -> (floor(x/y)=w16)
  Multiply(w16, w15) -> w17
  $"overhead offset" <- w17
