vi "Alamouti_RX_student.gvi"   [LabVIEW NXG]
inputs:
  "Modulation Parameters In": T6 = {"Modulation Type"="QPSK", "Control Information\nfor Packet Header/Tail"={"Training Sequence 1 (derived)"=[], "Zero Pad Length"=0, "Training Sequence 2 (derived)"=[]}, "RX Oversample Factor"=20, "Synchronization Options"={"Synchronization Method"="Timing Estimation", "Fixed Offset"=0, "Symbol Timing Recovery Method"="Max Energy", "Frame Detection Method"="Sliding Correlator", "Correct Frequency Offset"=FALSE}, "Number of Data Symbols (Derived)"=250, "RX Sample Rate"=4000000, "Pulse Shaping Parameters"={"Modulation Type"="PSK", "Pulse Shaping Filter"="Raised Cosine", "Filter Parameter"=0.5, "Filter Length (Symbols)"=8}, "Channel Estimation/Equalization Parameters"={"Equalization Method"="Direct", "Channel Estimate Length"=4, "Equalizer Length"=4, "Equalizer Delay"=-1}}
  "Input Complex Symbols 1": c128[]
  "Input Complex Symbols 2": c128[]
  "Channel estimates": T7
  "error in (no error)": error
outputs:
  "Output Complex Symbols": c128[]
  "Modulation Parameters Out": T6
  "error out": error
types:
  T1 = cluster{"Training Sequence 1 (derived)": c128[], "Zero Pad Length": i32, "Training Sequence 2 (derived)": c128[]}
  T2 = cluster{"Synchronization Method": string, "Fixed Offset": i32, "Symbol Timing Recovery Method": string, "Frame Detection Method": string, "Correct Frequency Offset": bool}
  T3 = enum{"none", "Raised Cosine", "Root Raised Cos", "Gaussian"}
  T4 = cluster{"Modulation Type": enum{"FSK", "PSK", "QAM", "MSK", "PAM", "ASK"}, "Pulse Shaping Filter": T3, "Filter Parameter": f64, "Filter Length (Symbols)": i32}
  T5 = cluster{"Equalization Method": string, "Channel Estimate Length": i32, "Equalizer Length": i32, "Equalizer Delay": i32}
  T6 = cluster{"Modulation Type": string, "Control Information\nfor Packet Header/Tail": T1, "RX Oversample Factor": i32, "Synchronization Options": T2, "Number of Data Symbols (Derived)": i32, "RX Sample Rate": f64, "Pulse Shaping Parameters": T4, "Channel Estimation/Equalization Parameters": T5}
  T7 = cluster{"Element 1": c128[], "Element 2": c128[], "Element 3": c128[], "Element 4": c128[]}
diagram:
  Property Node(instance in=$"Channel estimates") -> ("Element 1"=w1, "Element 2"=w2, "Element 3"=w3, "Element 4"=w4)
  Array Index(array=w1) -> (out0[0]=w5)
  # a1
  Absolute Value(x=w5) -> w6
  Square(x=w6) -> w7
  Array Index(array=w2) -> (out0[0]=w8)
  # a2
  Absolute Value(x=w8) -> w9
  Square(x=w9) -> w10
  Array Index(array=w3) -> (out0[0]=w11)
  Absolute Value(x=w11) -> w12
  # a3
  Square(x=w12) -> w13
  Array Index(array=w4) -> (out0[0]=w14)
  Absolute Value(x=w14) -> w15
  # a4
  Square(x=w15) -> w16
  Add(w7, w10, w13, w16) -> w17
  # r2,r6,r10
  # R3,r7,r11
  Decimate Array(array=$"Input Complex Symbols 2") -> (out0=w18, out1=w19)
  # h1*
  # h2*
  Complex Conjugate(x + iy=w11) -> w20
  Multiply(w20, w18) -> w21
  Complex Conjugate(x + iy=w19) -> w22
  Multiply(w14, w22) -> w23
  # r0,r4,r8
  # r1,r5,r9
  Decimate Array(array=$"Input Complex Symbols 1") -> (out0=w24, out1=w25)
  Complex Conjugate(x + iy=w25) -> w26
  Multiply(w8, w26) -> w27
  # ho*
  Complex Conjugate(x + iy=w5) -> w28
  Multiply(w28, w24) -> w29
  # ~s0,~s2,~s4
  Add(w29, w27, w21, w23) -> w30
  Complex Conjugate(x + iy=w8) -> w31
  Multiply(w31, w24) -> w32
  Multiply(w5, w26, -1+0i) -> w33
  # h3*
  Complex Conjugate(x + iy=w14) -> w34
  Multiply(w34, w18) -> w35
  Multiply(w11, w22, -1+0i) -> w36
  # ~s1,~s3,~s5
  Add(w32, w33, w35, w36) -> w37
  Interleave Array(w30, w37) -> w38
  Divide(x=w38, y=w17) -> w39
  $"Output Complex Symbols" <- w39
  $"error out" <- $"error in (no error)"
  $"Modulation Parameters Out" <- $"Modulation Parameters In"
