vi "Alamouti_TX_student.gvi"   [LabVIEW NXG]
inputs:
  "input symbols": c128[] = [1+0i, 2+0i, 3+0i, 4+0i, 0.707106781187+0.707106781187i, -0.707106781187+0.707106781187i, 0.707106781187+0.707106781187i, -0.707106781187-0.707106781187i, -0.707106781187+0.707106781187i, 0.707106781187+0.707106781187i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]
  "Modulation Parameters In": T4 = {"Modulation Type"="QPSK", "Pulse Shaping Parameters"={"Modulation Type"="PSK", "Pulse Shaping Filter"="Raised Cosine", "Filter Parameter"=0.5, "Filter Length (Symbols)"=8}, "TX Oversample Factor"=20, "Packet Length (Bits)"=500, "TX Sample Rate"=100, "Control Information For Packet Header/Tail"={"Training Sequences"="Length 11 Barker Sequence", "Zero Pad Length"=8}}
  "error in (no error)": error
outputs:
  "Modulation Parameters Out": T6
  "output 1": c128[]
  "output 2": c128[]
  "error out": error
types:
  T1 = enum{"none", "Raised Cosine", "Root Raised Cos", "Gaussian"}
  T2 = cluster{"Modulation Type": enum{"FSK", "PSK", "QAM", "MSK", "PAM", "ASK"}, "Pulse Shaping Filter": T1, "Filter Parameter": f64, "Filter Length (Symbols)": i32}
  T3 = cluster{"Training Sequences": string, "Zero Pad Length": i32}
  T4 = cluster{"Modulation Type": string, "Pulse Shaping Parameters": T2, "TX Oversample Factor": i32, "Packet Length (Bits)": i32, "TX Sample Rate": f64, "Control Information For Packet Header/Tail": T3}
  T5 = cluster{"Training Sequences ": string, "Zero Pad Length": i32}
  T6 = cluster{"Modulation Type": string, "Pulse Shaping Parameters": T2, "TX Oversample Factor": i32, "Packet Length (Bits)": i32, "TX Sample Rate": f64, "Control Information For Packet Header/Tail": T5}
diagram:
  case ($"error in (no error)") {
    frame No Error {
      # s0
      # s1
      Decimate Array(array=$"input symbols") -> (out0=w2, out1=w3)
      # antenna 0
      Complex Conjugate(x + iy=w3) -> w4
      Multiply(w4, -1) -> w5
      # s0
      Interleave Array(w2, w5) -> w6
      $"output 1" <- w6
      # antenna 1
      Complex Conjugate(x + iy=w2) -> w7
      # -s1*
      # s1
      # s0*
      Interleave Array(w3, w7) -> w8
      $"output 2" <- w8
      w1 = $"error in (no error)"
    }
    frame Error {
      w1 = $"error in (no error)"
    }
  }
  $"error out" <- w1
  $"Modulation Parameters Out" <- $"Modulation Parameters In"
