vi "Training sequence preprocessing_student.gvi"   [LabVIEW NXG]
inputs:
  "error in (no error)": error
  "Training Sequences in": T1 = {"Length 11 Zadoff Chu 1 "=[1+0i, 1+0i, 1+0i, 0+0i, 1+0i, 1+0i, 0+0i, 1+0i, 0+0i, 0+0i, 0+0i], "Length 11 Zadoff Chu 2"=[1+0i, 0+0i, 1+0i, 1+0i, 0+0i, 1+0i, 0+0i, 0+0i, 0+0i, 1+0i, 1+0i]}
outputs:
  "Training Sequences out": T1
  "error out": error
types:
  T1 = cluster{"Length 11 Zadoff Chu 1 ": c128[], "Length 11 Zadoff Chu 2": c128[]}
diagram:
  Property Node(instance in=$"Training Sequences in") -> ("Length 11 Zadoff Chu 1 "=w1, "Length 11 Zadoff Chu 2"=w2)
  Build Array[ConcatenateInputs=True](w1, w1, w1, w1) -> w3
  Array Size(array=w3) -> (size(s)=w4)
  Initialize Array(element=0+0i, size=w4) -> w5
  # data(44);0;0;0
  Build Array[ConcatenateInputs=True](w3, w5, w5, w5) -> w6
  Build Array[ConcatenateInputs=True](w2, w2, w2, w2) -> w7
  Array Size(array=w7) -> (size(s)=w8)
  Initialize Array(element=0+0i, size=w8) -> w9
  # 0;0;data(44);0
  Build Array[ConcatenateInputs=True](w9, w9, w7, w9) -> w10
  Build Cluster(w6, w10) -> w11
  $"Training Sequences out" <- w11
  $"error out" <- $"error in (no error)"
