vi "sliding_correlator_MIMO.gvi"   [LabVIEW NXG]
inputs:
  "Modulation Parameters In": T6 = {"Modulation Type"="QPSK", "Control Information\nfor Packet Header/Tail"={"Training Sequence 1 (derived)"=[], "Zero Pad Length"=0, "Training Sequence 2 (derived)"=[]}, "RX Oversample Factor"=20, "Synchronization Options"={"Synchronization Method"="Timing Estimation", "Fixed Offset"=0, "Symbol Timing Recovery Method"="Max Energy", "Frame Detection Method"="Sliding Correlator", "Correct Frequency Offset"=FALSE}, "Number of Data Symbols (Derived)"=250, "RX Sample Rate"=4000000, "Pulse Shaping Parameters"={"Modulation Type"="PSK", "Pulse Shaping Filter"="Raised Cosine", "Filter Parameter"=0.5, "Filter Length (Symbols)"=8}, "Channel Estimation/Equalization Parameters"={"Equalization Method"="Direct", "Channel Estimate Length"=4, "Equalizer Length"=4, "Equalizer Delay"=-1}}
  "Input Complex Waveform": cluster{"t0": f64, "dt": f64, "Y": c128[]} = {"t0"=0, "dt"=1, "Y"=[]}
  "error in (no error)": error
outputs:
  "Output": c128[]
  "Frame Offset": i32
  "Frequency Offset": f64
  "error out": error
types:
  T1 = cluster{"Training Sequence 1 (derived)": c128[], "Zero Pad Length": i32, "Training Sequence 2 (derived)": c128[]}
  T2 = cluster{"Synchronization Method": string, "Fixed Offset": i32, "Symbol Timing Recovery Method": string, "Frame Detection Method": string, "Correct Frequency Offset": bool}
  T3 = enum{"none", "Raised Cosine", "Root Raised Cos", "Gaussian"}
  T4 = cluster{"Modulation Type": enum{"FSK", "PSK", "QAM", "MSK", "PAM", "ASK"}, "Pulse Shaping Filter": T3, "Filter Parameter": f64, "Filter Length (Symbols)": i32}
  T5 = cluster{"Equalization Method": string, "Channel Estimate Length": i32, "Equalizer Length": i32, "Equalizer Delay": i32}
  T6 = cluster{"Modulation Type": string, "Control Information\nfor Packet Header/Tail": T1, "RX Oversample Factor": i32, "Synchronization Options": T2, "Number of Data Symbols (Derived)": i32, "RX Sample Rate": f64, "Pulse Shaping Parameters": T4, "Channel Estimation/Equalization Parameters": T5}
diagram:
  w1 = [1+0i, 1+0i, 1+0i, -1+0i, 1+0i, 1+0i, -1+0i, 1+0i, -1+0i, -1+0i, -1+0i]
  Build Array[ConcatenateInputs=True](w1, w1, w1, w1) -> w2
  w3 = [1+0i, -1+0i, 1+0i, 1+0i, -1+0i, 1+0i, -1+0i, -1+0i, -1+0i, 1+0i, 1+0i]
  Build Array[ConcatenateInputs=True](w3, w3, w3, w3) -> w4
  case ($"error in (no error)") {
    frame No Error {
      Property Node(instance in=$"Modulation Parameters In") -> ("Control Information\nfor Packet Header/Tail:Zero Pad Length"=w6, "Synchronization Options:Correct Frequency Offset"=w7)
      # 1. Zero pad input to make sure algorithm works better
      Property Node(instance in=$"Input Complex Waveform") -> ("Y"=w8)
      # 2. Correlate training sequence with input to find start of training sequence
      # input
      Array Size(array=w8) -> (size(s)=w9)
      # search through entire capture window for max correlation
      # correct frequency offset?
      Initialize Array(element=0, size=88) -> w10
      # input
      Initialize Array(element=0+0i, size=w6) -> w11
      Insert Into Array(inArray=w8, index0=0, new=w11) -> w12
      Complex Conjugate(x + iy=w2) -> w13
      call "1D Cross Correlation (CDB).gvi"(x=w12, y=w13) -> (rxy=w14)
      Absolute Value(x=w14) -> w15
      Square(x=w15) -> w16
      Build Array[ConcatenateInputs=True](w16, w10) -> w17
      Complex Conjugate(x + iy=w4) -> w18
      call "1D Cross Correlation (CDB).gvi"(x=w12, y=w18) -> (rxy=w19)
      Absolute Value(x=w19) -> w20
      Square(x=w20) -> w21
      # frame offset
      Build Array[ConcatenateInputs=True](w10, w21) -> w22
      Add(w17, w22) -> w23
      Array Max And Min(array=w23) -> (max index(es)=w24)
      Subtract(x=w9, y=w24) -> w25
      Decrement(x=w25) -> w26
      # 3. Apply frame offset
      Array Subset(array=w8, index0=w26) -> w27
      # 4. Apply Moose Algorithm for frequency offset correction
      case (w7) {
        frame False, Default {
          call "moose.gviprotected"(Modulation Parameters In=$"Modulation Parameters In", input=w27, Windows size=22) -> (frequency offset=w29)
          w28 = w27
        }
        frame True {
          call "moose.gviprotected"(Modulation Parameters In=$"Modulation Parameters In", input=w27, Windows size=22) -> (output=w28, frequency offset=w29)
        }
      }
      $Output <- w28
      $"Frequency Offset" <- w29
      # Remove offset added by zero padding
      Subtract(x=w26, y=w6) -> w30
      $"Frame Offset" <- w30
      w5 = $"error in (no error)"
    }
    frame Error {
      w5 = $"error in (no error)"
    }
  }
  $"error out" <- w5
