vi "student_LLSE.gvi"   [LabVIEW NXG]
inputs:
  "A": c128[][]
  "b": c128[]
outputs:
  "x.estimate": c128[]
  "mean square error": f64
diagram:
  # A^*
  call "Complex Conjugate Transpose Matrix.gvi"(input matrix=$A) -> (matrix conjugate transpose=w1)
  call "Complex A x B.gvi"(A=w1, B=$A) -> (A x B=w2)
  call "Complex Inverse Matrix.gvi"(input matrix=w2) -> (inverse matrix=w3)
  call "Complex A x B.gvi"(A=w3, B=w1) -> (A x B=w4)
  call "Complex A x Vector.gvi"(A=w4, vector=$b) -> (A x vector=w5)
  $"x.estimate" <- w5
  call "Complex A x Vector.gvi"(A=$A, vector=w5) -> (A x vector=w6)
  Subtract(x=w6, y=$b) -> w7
  call "Complex Vector Norm.gvi"(input vector=w7) -> (norm=w8)
  Square(x=w8) -> w9
  $"mean square error" <- w9
