vi "student_moose.gvi"   [LabVIEW NXG]
inputs:
  "Modulation Parameters In": T6 = {"Modulation Type"="QPSK", "Control Information\nfor Packet Header/Tail"={"Training Sequence 1 (derived)"=[], "Zero Pad Length"=0, "Training Sequence 2 (derived)"=[]}, "RX Oversample Factor"=20, "Synchronization Options"={"Synchronization Method"="Timing Estimation", "Fixed Offset"=0, "Symbol Timing Recovery Method"="Max Energy", "Frame Detection Method"="Sliding Correlator", "Correct Frequency Offset"=FALSE}, "Number of Data Symbols (Derived)"=250, "RX Sample Rate"=4000000, "Pulse Shaping Parameters"={"Modulation Type"="PSK", "Pulse Shaping Filter"="Raised Cosine", "Filter Parameter"=0.5, "Filter Length (Symbols)"=8}, "Channel Estimation/Equalization Parameters"={"Equalization Method"="Direct", "Channel Estimate Length"=4, "Equalizer Length"=4, "Equalizer Delay"=-1}}
  "Input": c128[]
  "Error In": error
outputs:
  "Error Out": error
  "Output": c128[]
  "Frequency Offset": f64
types:
  T1 = cluster{"Training Sequence 1 (derived)": c128[], "Zero Pad Length": i32, "Training Sequence 2 (derived)": c128[]}
  T2 = cluster{"Synchronization Method": string, "Fixed Offset": i32, "Symbol Timing Recovery Method": string, "Frame Detection Method": string, "Correct Frequency Offset": bool}
  T3 = enum{"none", "Raised Cosine", "Root Raised Cos", "Gaussian"}
  T4 = cluster{"Modulation Type": enum{"FSK", "PSK", "QAM", "MSK", "PAM", "ASK"}, "Pulse Shaping Filter": T3, "Filter Parameter": f64, "Filter Length (Symbols)": i32}
  T5 = cluster{"Equalization Method": string, "Channel Estimate Length": i32, "Equalizer Length": i32, "Equalizer Delay": i32}
  T6 = cluster{"Modulation Type": string, "Control Information\nfor Packet Header/Tail": T1, "RX Oversample Factor": i32, "Synchronization Options": T2, "Number of Data Symbols (Derived)": i32, "RX Sample Rate": f64, "Pulse Shaping Parameters": T4, "Channel Estimation/Equalization Parameters": T5}
diagram:
  Property Node(instance in=$"Modulation Parameters In") -> ("Control Information\nfor Packet Header/Tail"=w1, "RX Oversample Factor"=w2, "RX Sample Rate"=w3, "Channel Estimation/Equalization Parameters"=w4)
  # Symbol rate (T)
  Divide(x=w2, y=w3) -> w5
  Property Node(instance in=w1) -> ("Training Sequence 1 (derived)"=w6)
  Array Size(array=w6) -> (size(s)=w7)
  # Nt
  Quotient And Remainder(x=w7, y=16) -> (floor(x/y)=w8)
  # Diviseur
  Multiply(w8, w5, PiTimes2) -> w9
  # L+1
  Property Node(instance in=w4) -> ("Channel Estimate Length"=w10)
  # L
  Decrement(x=w10) -> w11
  Subtract(x=w8, y=w11) -> w12
  Add(w8, w11) -> w13
  Array Subset(array=$Input, index0=w13, length0=w12) -> w14
  Array Subset(array=$Input, index0=w11, length0=w12) -> w15
  # y(l)
  Complex Conjugate(x + iy=w15) -> w16
  Multiply(w14, w16) -> w17
  Add Array Elements(numeric array=w17) -> (sum=w18)
  Complex To Polar(r * e^(i*theta)=w18) -> (theta=w19)
  Divide(x=w19, y=w9) -> w20
  $"Frequency Offset" <- w20
  Multiply(w20, w5) -> w21
  for (N = w12) (iteration -> i1) {
    Real And Imaginary To Complex(x=0, y=-1) -> w22
    Multiply(w21, PiTimes2, w22, i1) -> w23
    Exponential(x=w23) -> w24
    Multiply(w14, w24) -> w25
  }
  $Output <- w25
  $"Error Out" <- $"Error In"
