vi "student_sliding_correlator.gvi"   [LabVIEW NXG]
inputs:
  "Modulation Parameters In": T6 = {"Modulation Type"="QPSK", "Control Information\nfor Packet Header/Tail"={"Training Sequence 1 (derived)"=[], "Zero Pad Length"=0, "Training Sequence 2 (derived)"=[]}, "RX Oversample Factor"=20, "Synchronization Options"={"Synchronization Method"="Timing Estimation", "Fixed Offset"=0, "Symbol Timing Recovery Method"="Max Energy", "Frame Detection Method"="Sliding Correlator", "Correct Frequency Offset"=FALSE}, "Number of Data Symbols (Derived)"=250, "RX Sample Rate"=4000000, "Pulse Shaping Parameters"={"Modulation Type"="PSK", "Pulse Shaping Filter"="Raised Cosine", "Filter Parameter"=0.5, "Filter Length (Symbols)"=8}, "Channel Estimation/Equalization Parameters"={"Equalization Method"="Direct", "Channel Estimate Length"=4, "Equalizer Length"=4, "Equalizer Delay"=-1}}
  "Input Complex Waveform": cluster{"t0": f64, "dt": f64, "Y": c128[]} = {"t0"=0, "dt"=1, "Y"=[]}
  "error in (no error)": error
outputs:
  "Output": c128[]
  "Frame Offset": i32
  "Frequency Offset": f64
  "error out": error
types:
  T1 = cluster{"Training Sequence 1 (derived)": c128[], "Zero Pad Length": i32, "Training Sequence 2 (derived)": c128[]}
  T2 = cluster{"Synchronization Method": string, "Fixed Offset": i32, "Symbol Timing Recovery Method": string, "Frame Detection Method": string, "Correct Frequency Offset": bool}
  T3 = enum{"none", "Raised Cosine", "Root Raised Cos", "Gaussian"}
  T4 = cluster{"Modulation Type": enum{"FSK", "PSK", "QAM", "MSK", "PAM", "ASK"}, "Pulse Shaping Filter": T3, "Filter Parameter": f64, "Filter Length (Symbols)": i32}
  T5 = cluster{"Equalization Method": string, "Channel Estimate Length": i32, "Equalizer Length": i32, "Equalizer Delay": i32}
  T6 = cluster{"Modulation Type": string, "Control Information\nfor Packet Header/Tail": T1, "RX Oversample Factor": i32, "Synchronization Options": T2, "Number of Data Symbols (Derived)": i32, "RX Sample Rate": f64, "Pulse Shaping Parameters": T4, "Channel Estimation/Equalization Parameters": T5}
diagram:
  # t
  # Nt
  Property Node(instance in=$"Modulation Parameters In") -> ("Control Information\nfor Packet Header/Tail:Training Sequence 1 (derived)"=w1, "Control Information\nfor Packet Header/Tail:Zero Pad Length"=w2, "Control Information\nfor Packet Header/Tail:Training Sequence 2 (derived)"=w3, "Synchronization Options:Correct Frequency Offset"=w4)
  # y
  Property Node(instance in=$"Input Complex Waveform") -> ("Y"=w5)
  Array Size(array=w5) -> (size(s)=w6)
  Complex Conjugate(x + iy=w3) -> w7
  Initialize Array(element=0+0i, size=w2) -> w8
  Insert Into Array(inArray=w5, index0=0, new=w8) -> w9
  call "1D Cross Correlation (CDB).gvi"(x=w9, y=w7) -> (rxy=w10)
  Absolute Value(x=w10) -> w11
  Square(x=w11) -> w12
  Complex Conjugate(x + iy=w1) -> w13
  call "1D Cross Correlation (CDB).gvi"(x=w9, y=w13) -> (rxy=w14)
  Absolute Value(x=w14) -> w15
  Square(x=w15) -> w16
  Add(w16, w12) -> w17
  Array Max And Min(array=w17) -> (max index(es)=w18)
  Subtract(x=w6, y=w18) -> w19
  Decrement(x=w19) -> w20
  Array Subset(array=w5, index0=w20) -> w21
  case (w4) {
    frame False, Default {
      call "student_moose.gvi"(Modulation Parameters In=$"Modulation Parameters In", Input=w21) -> (Frequency Offset=w23)
      w22 = w21
    }
    frame True {
      call "student_moose.gvi"(Modulation Parameters In=$"Modulation Parameters In", Input=w21) -> (Output=w22, Frequency Offset=w23)
    }
  }
  $Output <- w22
  $"Frequency Offset" <- w23
  Subtract(x=w20, y=w2) -> w24
  $"Frame Offset" <- w24
  $"error out" <- $"error in (no error)"
