vi "TXRF_init_MIMO.gvi"   [LabVIEW NXG]
inputs:
  "HW Parameters In": T1 = {"Active Antenna"="TX1", "Carrier Frequency (Hz)"=915000000, "Gain (dB)"=10, "Generation Mode"="Single Shot", "Device IP Address"="192.168.11.2"}
  "Modulation Parameters In": T5 = {"Modulation Type"="QPSK", "Pulse Shaping Parameters"={"Modulation Type"="PSK", "Pulse Shaping Filter"="Root Raised Cos", "Filter Parameter"=0.5, "Filter Length (Symbols)"=8}, "TX Oversample Factor"=20, "Packet Length (Bits)"=500, "TX Sample Rate"=100, "Control Information For Packet Header/Tail"={"Training Sequences "="Zadoff Chu", "Zero Pad Length"=8}}
  "error in": error
outputs:
  "error out": error
  "HW Parameters Out": T1
  "Modulation Parameters Out": T5
  "queue out": cluster{"Key Bit Sequence": Queue<u8[]>}
  "coerced carrier frequency (Hz)": f64
  "coerced gain (dB)": f64
  "USRP Session out": niUSRP
panel controls:
  "start trigger time": T6 = {"whole seconds"=1, "fractional seconds"=0}
types:
  T1 = cluster{"Active Antenna": string, "Carrier Frequency (Hz)": f64, "Gain (dB)": f64, "Generation Mode": enum{"Single Shot", "Simulate", "Continuous"}, "Device IP Address": string}
  T2 = enum{"none", "Raised Cosine", "Root Raised Cos", "Gaussian"}
  T3 = cluster{"Modulation Type": enum{"FSK", "PSK", "QAM", "MSK", "PAM", "ASK"}, "Pulse Shaping Filter": T2, "Filter Parameter": f64, "Filter Length (Symbols)": i32}
  T4 = cluster{"Training Sequences ": string, "Zero Pad Length": i32}
  T5 = cluster{"Modulation Type": string, "Pulse Shaping Parameters": T3, "TX Oversample Factor": i32, "Packet Length (Bits)": i32, "TX Sample Rate": f64, "Control Information For Packet Header/Tail": T4}
  T6 = cluster{"whole seconds": u64, "fractional seconds": f64}
diagram:
  $"Modulation Parameters Out" <- $"Modulation Parameters In"
  $"HW Parameters Out" <- $"HW Parameters In"
  case ($"error in") {
    frame No Error {
      Obtain Queue(element data type=u8[] [], name (unnamed)="Key Bit Sequence ") -> (queue out=w2)
      Build Cluster(w2) -> w3
      $"queue out" <- w3
      Property Node(instance in=$"HW Parameters In") -> ("Generation Mode"=w4)
      case (w4) {
        frame "Simulate", Default {
          w1 = $"error in"
        }
        frame "Single Shot", "Continuous" {
          Property Node(instance in=$"HW Parameters In") -> ("Device IP Address"=w5, "Active Antenna"=w6, "Carrier Frequency (Hz)"=w7, "Gain (dB)"=w8)
          Property Node(instance in=$"Modulation Parameters In") -> ("TX Sample Rate"=w9)
          call "niUSRP Open Tx Session.gvi"(Device names=w5, error in (no error)=$"error in") -> (Error Out=w10, Session handle=w11)
          Property Node(instance in=w11, error in=w10, "Configuration:Enabled Channels"="0,1") -> (instance out=w12, error out=w13)
          call "niUSRP Configure Time Start Trigger.gvi"(session handle=w12, start trigger time=$"start trigger time", error in (no error)=w13) -> (session handle out=w14, Error Out=w15)
          Property Node(instance in=w14, error in=w15, "Configuration:IQ Rate"=w9, "Configuration:Carrier Frequency"=w7) -> (instance out=w16, error out=w17, "Configuration:Carrier Frequency"=w18)
          $"coerced carrier frequency (Hz)" <- w18
          Property Node(instance in=w16, error in=w17, "Active Channel"="0", "Configuration:Gain"=w8, "Configuration:Active Antenna"=w6) -> (instance out=w19, error out=w20)
          Property Node(instance in=w19, error in=w20, "Active Channel"="1", "Configuration:Gain"=w8, "Configuration:Active Antenna"=w6, "Clocking and Synchronization:Reference Frequency Source"="Mimo", "Clocking and Synchronization:Timebase Clock Source"="Mimo") -> (instance out=w21, error out=w22)
          call "niUSRP Set Time.gvi"(session handle=w21, timestamp=T6 {all zero or empty}, error in (no error)=w22, channel list="0,1") -> (session handle out=w23, Error Out=w1)
          $"USRP Session out" <- w23
        }
      }
    }
    frame Error {
      w1 = $"error in"
    }
  }
  $"error out" <- w1
